# Dynamo graph Etiquetas-Centradas.dyn (Dynamo 2.13.1.3887)
# packages: Modelical 2022.6.15

categories = Categories("OST_Rooms")
all_elements_of_category = ElementsOfCategory(Category=categories)
centerLocationAndTags = Custom[Room.CenterLocationAndTags](rooms=all_elements_of_category)  # package Modelical; This node moves the room location of the selected rooms to the closest possible point to geometrical center. Also modifies the associated room tags in all model.
