# Dynamo graph Generacion de planos (vacios).dyn "Generacion de planos" (Dynamo 2.13.1.3887)
# Genera planos a partir de un fichero excel, genera solo la plantilla de los planos

# group: Seleccionamos el fichero excel con los planos
ruta_de_fichero_excel = Filename("No hay ningún archivo seleccionado.")  # graph input
file_from_path = FileObject(path=ruta_de_fichero_excel)
nombre_de_la_hoja_de_excel = StringInput("")  # graph input
importExcel = Data.ImportExcel(file=file_from_path, sheetName=nombre_de_la_hoja_de_excel)

# group: Creacion del plano
restOfItems = List.RestOfItems(list=importExcel)
transpose = List.Transpose(lists=restOfItems)
code_block = CodeBlock(a=transpose) { a[1]; }
code_block_2 = CodeBlock(a=transpose) { a[0]; }
family_types = FamilyTypes("A1 métrico:A1 métrico")
byNameNumberTitleBlock = Sheet.ByNameNumberTitleBlock(sheetName=code_block, sheetNumber=code_block_2, titleBlockFamilyType=family_types)

# group: Asignamos valores de los planos
code_block_3 = CodeBlock(a=importExcel) { a[0]; }
code_block_4 = CodeBlock { [0, 1]; }
removeItemAtIndex = List.RemoveItemAtIndex(list=code_block_3, indices=code_block_4)
removeItemAtIndex_2 = List.RemoveItemAtIndex(list=transpose, indices=code_block_4)
setParameterByName = Element.SetParameterByName(element=byNameNumberTitleBlock, parameterName=removeItemAtIndex@L1, value=removeItemAtIndex_2@L2)
