# Dynamo graph Modelado acabado de muros version 2.dyn (Dynamo 2.13.1.3887)
# packages: Clockwork for Dynamo 2.x 2.4.0

# group: Selecciona las habitaciones
categories = Categories("OST_Rooms")
all_elements_of_category = ElementsOfCategory(Category=categories)
code_block = CodeBlock(x=all_elements_of_category) { x.Name; }
boundaries = Custom[Room.Boundaries](room=all_elements_of_category)  # package Clockwork for Dynamo 2.x; Gets a list of all boundaries of a given room or area and a corresponding list of the elements that are generating those boundaries.

# group: Elimina vectores sobreantess
startPoint = Curve.StartPoint(curve=boundaries.curves)
direction = Line.Direction(line=boundaries.curves)
code_block_2 = CodeBlock { 1; }
shiftIndices = List.ShiftIndices(list=direction@L2, amount=code_block_2)
angleWithVector = Vector.AngleWithVector(vector=direction, otherVector=shiftIndices)
floor = Math.Floor(number=angleWithVector)
code_block_3 = CodeBlock { 0; }
eq = floor == code_block_3
filterByBoolMask = List.FilterByBoolMask(list=startPoint, mask=eq)
identity = Object.Identity(object=filterByBoolMask.out)
boolean = BoolSelector(true)
byPoints = PolyCurve.ByPoints(points=identity, connectLastToFirst=boolean)

selecciona_el_acabado_del_muro = WallTypes()  # nothing selected; graph input
code_block_4 = CodeBlock { "Anchura"; }
getParameterValueByName = Element.GetParameterValueByName(element=selecciona_el_acabado_del_muro, parameterName=code_block_4)
code_block_5 = CodeBlock(x=getParameterValueByName) { -x/2; }
offset = Curve.Offset(curve=byPoints, distance=code_block_5)
explode = Geometry.Explode(geometry=offset)
indica_la_altura_de_los_muros = DoubleInput(0)  # graph input
indica_el_nivel = Levels()  # nothing selected; graph input
byCurveAndHeight = Wall.ByCurveAndHeight(curve=explode, height=indica_la_altura_de_los_muros, level=indica_el_nivel, wallType=selecciona_el_acabado_del_muro)
doors = Custom[Room.Doors](room=all_elements_of_category)  # package Clockwork for Dynamo 2.x; Retrieves all doors that are associated with a room (hosted in walls and roofs).
windows = Custom[Room.Windows](room=all_elements_of_category)  # package Clockwork for Dynamo 2.x; Retrieves all windows that are associated with a room (hosted in walls and roofs).
join = List.Join(list0=doors, list1=windows)
flatten = List.Flatten(list=join)
getHost = FamilyInstance.GetHost(familyInstance=flatten)
uniqueItems = List.UniqueItems(list=getHost)
identity_2 = Object.Identity(object=uniqueItems)
joinGeometry = Custom[Element.JoinGeometry](element1=byCurveAndHeight, element2=identity_2, lacing=CrossProduct)  # package Clockwork for Dynamo 2.x; Joins two model elements (if possible). Only works inside the project environment.
