# Dynamo graph Modelado acabado de muros.dyn "Wall-Finishes" (Dynamo 2.13.1.3887)
# packages: Data-Shapes 2022.2.105, Modelical 2022.6.15

# group: Nota acabado muro
code_block = CodeBlock { "Nombre del parámetro que almacena el acabado de muro"; }
textnote_data = Custom[TextNote Data](TextNote=code_block)  # package Data-Shapes; Create Data for TextNote input in UI.MultipleInputForm ++ . Check out www.data-shapes.net for more informations

# group: Obtenemos Habitaciones
categories = Categories("OST_Rooms")
all_elements_of_category = ElementsOfCategory(Category=categories)

# group: Quitamos las nulas
location = Room.Location(room=all_elements_of_category)
isNull = Object.IsNull(object=location)
filterByBoolMask = List.FilterByBoolMask(list=all_elements_of_category, mask=isNull)

# group: Crear idenificadores de Habitaciones
number = Room.Number(room=filterByBoolMask.out)
name = Room.Name(room=filterByBoolMask.out)
code_block_2 = CodeBlock { "Nivel"; }
getParameterValueByName = Element.GetParameterValueByName(element=filterByBoolMask.out, parameterName=code_block_2)
height = Room.Height(room=filterByBoolMask.out)
code_block_3 = CodeBlock(a=number, b=name, c=getParameterValueByName, d=height) { a + " - " + b + " - " + c + " - " + d; }

# group: Lista de habitaciones disponibles
code_block_4 = CodeBlock { "Seleccione las habitaciones"; }
listview_data = Custom[Listview Data](InputName=code_block_4, Keys=code_block_3, Values=filterByBoolMask.out)  # package Data-Shapes; Create data for ListView input in UI.MultiInputForm ++ . Check out www.data-shapes.net for more infos.

# group: Selector
code_block_5 = CodeBlock { "Seleccione habitaciones para crear el acabado de los muros"; "Crear"; "Cancelar"; }
list_create = List.Create(item0=listview_data)
boolean = BoolSelector(true)
multipleinputform = Custom[MultipleInputForm ++](Description_optional=code_block_5.out0, ButtonText_optional=code_block_5.out1, Inputs=list_create, Toggle=boolean, CancelButtonText_optional=code_block_5.out2)  # package Data-Shapes; Create a form with multiple inputs. see www.data-shapes.net for tutorials and infos!

# group: Acabado de muro parámetro input
# note: Nombre del parámetro a rellenar
code_block_6 = CodeBlock { "Acabado de muro"; }
textbox_data = Custom[TextBox Data](DefaultText=code_block_6)  # package Data-Shapes; Create Data for TextBox input in UI.MultipleInputForm ++ . Check out www.data-shapes.net for more informations

# group: Crear Acabado de muros
code_block_7 = CodeBlock(x=multipleinputform.User_Inputs) { x[0]; }
# note: Nombre del parámetro de la altura
code_block_8 = CodeBlock { "Altura sin límites"; }
wallFinishesByRoom = Custom[Wall.WallFinishesByRoom](rooms=code_block_7, wallFinishesParam=code_block_6, finishesHeightParam=code_block_8, lacing=Longest)  # package Modelical; This node places room wall finishes using the info contained in the parameters (selected by name) where is defined the wall finishes type and the finishes height.
