# Dynamo graph Modelado acabados de suelo.dyn (Dynamo 2.13.1.3887)
# Automatiza el modelado de acabados de suelo en Revit, mejorando la eficiencia y precisión del diseño
# packages: archi-lab.net 2023.213.1722

# group: 1. Seleccionamos las habitaciones
selecciona_las_habitaciones = DSModelElementsByCategorySelection("OST_Rooms")  # nothing selected; graph input
string = StringInput("Finish")
boundaries = archilab.Revit.Elements.Room.Boundaries(room=selecciona_las_habitaciones, boundaryLocation=string)

# group: 2. Filtramos el tipo de suelo y el nivel en el que se aplica
tipos_de_suelo = FloorTypes("Con bovedilla cerámica - 30 cm")  # graph input
selecciona_la_planta = Levels("Nivel 1")  # graph input
byOutlineTypeAndLevel = Floor.ByOutlineTypeAndLevel(outlineCurves=boundaries.Curves, floorType=tipos_de_suelo, level=selecciona_la_planta)

# group: 3. Personalizacion del desfase
string_2 = StringInput("Desfase de altura desde nivel")
desfase_automatico = BoolSelector(true)  # graph input
string_3 = StringInput("Grosor predeterminado")
getParameterValueByName = Element.GetParameterValueByName(element=tipos_de_suelo, parameterName=string_3)
desfase_personalizado = DoubleInput(0)  # graph input
if_ = RefactoredIf(test=desfase_automatico, true=getParameterValueByName, false=desfase_personalizado)
setParameterByName = Element.SetParameterByName(element=byOutlineTypeAndLevel, parameterName=string_2, value=if_)
