# Dynamo graph Montaje3DMass.dyn (Dynamo 2.13.1.3887)
# Genera la masa de las habitaciones
# packages: spring nodes 210.1.1, Genius Loci 2023.2.21, Data-Shapes 2022.2.105

# group: Seleccionamos las habitaciones/rooms
code_block = CodeBlock { "Habitaciones"; }
byName = Category.ByName(name=code_block)
all_elements_of_category = ElementsOfCategory(Category=byName)

# group: Filtramos aquellas que no tienen una localización establecida
location = Room.Location(room=all_elements_of_category)
isNull = Object.IsNull(object=location)
filterByBoolMask = List.FilterByBoolMask(list=all_elements_of_category, mask=isNull)

# group: Obtenemos la geometría
geometry = Element.Geometry(element=filterByBoolMask.out)
flatten = List.Flatten(list=geometry)

# note: Necesitamos la ruta al archivo de MetricMass.rft
file_path = Filename(".\Masa métrica.rft")

# group: Generamos los nombres de los archivos
number = Room.Number(room=filterByBoolMask.out)
name = Room.Name(room=filterByBoolMask.out)
# note: Parámetro
code_block_2 = CodeBlock { "Nombre"; }
getParameterValueByName = Element.GetParameterValueByName(element=filterByBoolMask.out, parameterName=code_block_2)
code_block_3 = CodeBlock(a=number, b=name, c=getParameterValueByName) { a+ " - " + b + " - "+ c +" - "; }

code_block_4 = CodeBlock { "Masa"; }
byName_2 = Category.ByName(name=code_block_4)
ꟿ_familyinstance_bygeometry = Custom[ꟿ FamilyInstance.ByGeometry](geometry=flatten, familyTemplatePath=file_path, familyName=code_block_3, category=byName_2)  # package spring nodes; You must provide a valid family template path that will be used for all input geometry objects. The project units(and not the templates) will be used to determine the size of the output geometry. The provided category will be used only if the family template supports it. If not, the default template category will be used instead. Likewise, the family material(provided as a string) will be set only if a material with that name exists in the template. If not, the default material will be used instead ("By Category"). For void cuts, the material settings will be ignored. The Subcategory name is an optional input. If you'd like to skip assigning a Subcategory to any new instance, simply use null. The node expects a unique family name for each geometry object. The rest of the input lists will be processed as if the node lacing is set to longest.

# group: Agrupamos Geometría
groupByKey = List.GroupByKey(list=ꟿ_familyinstance_bygeometry.instance, keys=getParameterValueByName)
flatten_2 = List.Flatten(list=groupByKey.groups)

# group: Creamos el selector de las vistas
code_block_5 = CodeBlock { "Crear Masas"; "Crear con colores de la vista selección"; "Crear masas sin color"; }
code_block_6 = CodeBlock()
# ---------- code_block_6.designscript (2 lines) ----------
"Selecciona la vista donde está el esquema de colores
(Recuerda que debes ejecutar esto desde la vista 3D)";
# ----------------------------------------
categories = Categories("OST_Views")
all_elements_of_category_2 = ElementsOfCategory(Category=categories)
isNull_2 = Object.IsNull(object=all_elements_of_category_2)
filterByBoolMask_2 = List.FilterByBoolMask(list=all_elements_of_category_2, mask=isNull_2)
isViewTemplate = View.IsViewTemplate(view=filterByBoolMask_2.out)
filterByBoolMask_3 = List.FilterByBoolMask(list=filterByBoolMask_2.out, mask=isViewTemplate)
name_2 = Element.Name(element=filterByBoolMask_3.out)
dropdown_data = Custom[DropDown Data](InputName=code_block_6, Keys=name_2, Values=filterByBoolMask_3.out)  # package Data-Shapes; Create data for DropDown input in UI.MultiInputForm ++ . Check out www.data-shapes.net for more infos.
boolean = BoolSelector(true)
multipleinputform = Custom[MultipleInputForm ++](Description_optional=code_block_5.out0, ButtonText_optional=code_block_5.out1, Inputs=dropdown_data, Toggle=boolean, CancelButtonText_optional=code_block_5.out2)  # package Data-Shapes; Create a form with multiple inputs. see www.data-shapes.net for tutorials and infos!

# group: Seleccionar el esquema de color de la vista seleccionada
code_block_7 = CodeBlock { "Habitaciones"; }
byName_3 = Category.ByName(name=code_block_7)
view_get_colorfill_scheme = Custom[View Get ColorFill Scheme](view=multipleinputform.User_Inputs, category=byName_3)  # package Genius Loci; Works only in Revit 2022 and later. Returns the color fill scheme element applied to the view.

isNull_3 = Object.IsNull(object=view_get_colorfill_scheme)
code_block_8 = CodeBlock { true; false; }
if_ = RefactoredIf(test=isNull_3, true=code_block_8.out0, false=code_block_8.out1)

# group: Agrupamos por Nombre
groupByKey_2 = List.GroupByKey(list=getParameterValueByName, keys=getParameterValueByName)

# group: Establecer los colores
get_colorfill_scheme_properties = Custom[Get ColorFill Scheme Properties](colorFillScheme=view_get_colorfill_scheme)  # package Genius Loci; Works only in Revit 2022 and later. Gets the category, values, colors and fill patterns of the given Color Scheme.
indexOf = List.IndexOf(list=get_colorfill_scheme_properties.Values@L2, element=groupByKey_2.groups)
getItemAtIndex = List.GetItemAtIndex(list=get_colorfill_scheme_properties.Colors@L2, index=indexOf)
flatten_3 = List.Flatten(list=getItemAtIndex)

# group: Obtener el patrón de relleno
code_block_9 = CodeBlock { "<Relleno Uniforme>"; "Drafting"; }
getByName = FillPatternElement.GetByName(name=code_block_9.out0)

# group: Cargar y sobreescribir los elementos
code_block_10 = CodeBlock { null; }
byProperties = Revit.Filter.OverrideGraphicSettings.ByProperties(cutFillColor=flatten_3, projectionFillColor=flatten_3, cutFillPattern=getByName, projectionFillPattern=getByName)
if_2 = RefactoredIf(test=if_, true=code_block_10, false=byProperties)
overrideInView = Element.OverrideInView(element=flatten_2, overrides=if_2@L2)
watch = Watch(if_2)

code_block_11 = CodeBlock { "../Masa métrica.rft"; }
