# Dynamo graph Rodapies por habitacion.dyn "rodapie por habitacion_DEMO" (Dynamo 2.0.3.8810)

# group: DESCRIPCIÓN
# note: DYNAMO FILE NAME
# rodapie por habitacion.dyn
# note: AUTOR
# Joan Moretó(DominaDynamo)
# note: DESCRIPCIÓN
# Genera barridos de muro o telares en el perímetro de las habitaciones seleccionadas.
# note: VERSIÓN DE DYNAMO COMPROBADA
# 2.0.3
# note: VERSIÓN DE REVIT MÍNIMA COMPROBADA
# 2018 ESP
# note: PAQUETES DE DYNAMO NECESARIOS
# DominaDynamo, Clockwork for Dynamo 2.x, Rythm, archilab.net

# group: input
# note: input
tipo_de_barrido_telar = StringInput("Rodapié madera")  # graph input

# note: element type by type name
python_script = Python(IN[0]=tipo_de_barrido_telar)
# ---------- python_script.python (47 lines) ----------
import clr

clr.AddReference('RevitAPI')
import Autodesk
from Autodesk.Revit.DB import *
#The inputs to this node will be stored as a list in the IN variables.
clr.AddReference('RevitServices')
import RevitServices

from RevitServices.Persistence import DocumentManager


doc = DocumentManager.Instance.CurrentDBDocument
uiapp = DocumentManager.Instance.CurrentUIApplication
app = uiapp.Application

doc = DocumentManager.Instance.CurrentDBDocument

collector = FilteredElementCollector(doc).OfClass(ElementType).ToElements()

nomtipo=IN[0]



lang = app.Language
resu=0

if str(lang) == 'English_USA' or str(lang) == "English_GB":
	for e in collector:
		p = e.LookupParameter("Type Name")	
		res=p.AsString()
		if res == nomtipo:
			resu=e
			
		
elif str(lang) == 'Spanish':
	for e in collector:
		p = e.LookupParameter("Nombre de tipo")	
		res=p.AsString()
		if res == nomtipo:
			resu=e
			
if resu!=0:
	OUT = resu
	
else:
	OUT ="En el modelo no existe el tipo "+nomtipo+". Compruebe mayus/minus y espacios"
# ----------------------------------------

# group: mensaje de error
code_block = CodeBlock { "El tipo introducido no existe"; }
type = Object.Type(obj=python_script)
code_block_2 = CodeBlock { "String"; }
contains = String.Contains(str=type, searchFor=code_block_2)
mensaje_de_error_sencillo = Custom[Mensaje de error.Sencillo](texto=python_script, titulo=code_block, ejecutar=contains)  # Crrea un mensaje de error a partir de un texto.

# group: selección de habitaciones
boolean = BoolSelector(true)
code_block_3 = CodeBlock { "Rooms"; }
byName = Category.ByName(name=code_block_3)
isolated_pick_model_elements = Custom[Isolated Pick Model Elements](refresh=boolean, Category=byName)  # This allows a multiple selection of elements of specified category.

# group: comprueba si es barrido
code_block_4 = CodeBlock { "Family Name"; }
code_block_5 = CodeBlock { "Nombre de familia"; }
input_ingles_castellano = Custom[Input ingles_castellano](english=code_block_4, castellano=code_block_5)  # Permite introducir un texto en inglés y en castellano de modo que se obtiene el correpondiente al idioma de ejecución de Revit
getParameterValueByName = Element.GetParameterValueByName(element=python_script, parameterName=input_ingles_castellano)
code_block_6 = CodeBlock { "Wall Sweep"; }
code_block_7 = CodeBlock { "Barrido de muro"; }
input_ingles_castellano_2 = Custom[Input ingles_castellano](english=code_block_6, castellano=code_block_7)
eq = getParameterValueByName == input_ingles_castellano_2
code_block_8 = CodeBlock { false; }
code_block_9 = CodeBlock { true; }
if_ = If(test=eq, true=code_block_8, false=code_block_9)

distancia_a_muro = DoubleInput(0)  # graph input
code_block_10 = CodeBlock { 0.5; }

# group: obtiene limites de habitacion y comprueba int/ext
python_script_2 = Python(IN[0]=isolated_pick_model_elements)
# ---------- python_script_2.python (10 lines) ----------
#Plantilla de Python DominaDynamo
# Activar la compatibilidad con Python y cargar biblioteca de DesignScript
import clr
clr.AddReference('ProtoGeometry')
from Autodesk.DesignScript.Geometry import *

l=[]
l.append(IN[0][0])

OUT = l
# ----------------------------------------
# note: Clockwork
boundaries = Custom[Room.Boundaries](room=python_script_2)  # Gets a list of all boundaries of a given room or area and a corresponding list of the elements that are generating those boundaries.

# group: filtra separadores de habitación
type_2 = Object.Type(obj=boundaries.elements)
code_block_11 = CodeBlock { "Wall"; }
contains_2 = String.Contains(str=type_2, searchFor=code_block_11)
filterByBoolMask = List.FilterByBoolMask(list=boundaries.elements, mask=contains_2)
filterByBoolMask_2 = List.FilterByBoolMask(list=boundaries.curves, mask=contains_2)

# group (continued): obtiene limites de habitacion y comprueba int/ext
exteriorDirection = Custom[Wall.ExteriorDirection](Wall_var=filterByBoolMask.in)  # This node returns exterior direction of the wall as a vector.
normalAtParameter = Curve.NormalAtParameter(curve=filterByBoolMask_2.in, param=code_block_10)
isAlmostEqualTo = Vector.IsAlmostEqualTo(vector=exteriorDirection@@L1, other=normalAtParameter@L1)

# group: crea barridos/telares
boolean_2 = BoolSelector(false)
python_script_3 = Python(IN[0]=filterByBoolMask.in, IN[1]=python_script, IN[2]=if_, IN[3]=boolean_2, IN[4]=distancia_a_muro, IN[5]=isAlmostEqualTo)
# ---------- python_script_3.python (66 lines) ----------
#generar barridos o telares a partir de listas de muros

import clr
clr.AddReference('RevitAPI')
from Autodesk.Revit.DB import*
clr.AddReference('RevitServices')
from RevitServices.Persistence import DocumentManager
from RevitServices.Transactions import TransactionManager


doc = DocumentManager.Instance.CurrentDBDocument

if isinstance(IN[0],list):
	walls = [UnwrapElement(i) for i in IN[0]]
else:
	walls = [UnwrapElement(IN[0])]
wstype = ElementId(IN[1].Id)
sr = IN[2]
vertical = IN[3]
reverse=IN[5]

UIunit = Document.GetUnits(doc).GetFormatOptions(UnitType.UT_Length).DisplayUnits
dist = UnitUtils.ConvertToInternalUnits(IN[4],UIunit)

#creating wallsweepinfo
if not sr:
	wsi = WallSweepInfo(WallSweepType.Sweep,vertical)
else:
	wsi = WallSweepInfo(WallSweepType.Reveal,vertical)




#setting distance of sweep
wsi.Distance = dist

#creating wallsweep
TransactionManager.Instance.EnsureInTransaction(doc)
ws = []
r2=[]

for wl,rev in zip(walls,reverse):



	for w,re in zip(wl,rev):
	
		if re==True:	
			wi=WallSide.Interior
			WallSweepInfo.WallSide.SetValue(wsi,wi)
	
		else:
			wi=WallSide.Exterior
			WallSweepInfo.WallSide.SetValue(wsi,wi)
			
		bar=WallSweep.Create(w,wstype,wsi)
		ws.append(bar)
		r2.append(bar.GetWallSweepInfo().WallSide)
		
		
	
TransactionManager.Instance.TransactionTaskDone()



OUT = ws
# ----------------------------------------

# group: desfase desde nivel
code_block_12 = CodeBlock { "Offset From Level"; }
code_block_13 = CodeBlock { "Desfase desde nivel"; }
input_ingles_castellano_3 = Custom[Input ingles_castellano](english=code_block_12, castellano=code_block_13)
desfase_desde_nivel = DoubleInput(0)  # graph input
setParameterByName = Element.SetParameterByName(element=python_script_3, parameterName=input_ingles_castellano_3, value=desfase_desde_nivel)

# group: DEMO
code_block_14 = CodeBlock { "Este es un script gratuito de demostración limitado a un máximo de una habitación. Puede obtener el script sin limitaciones en www.dominadynamo.com/utilidades"; }
code_block_15 = CodeBlock { "Aviso: Archivo de demostración"; }
count = List.Count(list=isolated_pick_model_elements)
code_block_16 = CodeBlock { 1; }
gt = count > code_block_16
mensaje_de_error_sencillo_2 = Custom[Mensaje de error.Sencillo](texto=code_block_14, titulo=code_block_15, ejecutar=gt)
