# Dynamo graph Warnings.dyn (Dynamo 2.13.1.3887)
# packages: spring nodes 210.1.1, Clockwork for Dynamo 2.x 2.4.0

# group: Generar errores
current = Document.Current()
getWarnings = Warning.GetWarnings(document=current)
getFailingElements = Warning.GetFailingElements(warning=getWarnings)
flatten = List.Flatten(list=getFailingElements)

# group: Generar Color
color_palette = ColorPalette({R: 220, G: 20, B: 60, A: 255})
overrideColorInView = Element.OverrideColorInView(element=flatten, color=color_palette)
current_2 = Document.Current()
activeView = Document.ActiveView(document=current_2)
code_block = CodeBlock { 20; }
overrideElementTransparency = Custom[View.OverrideElementTransparency](element=flatten, view=activeView, transparencyPercentage=code_block)  # package Clockwork for Dynamo 2.x; Overrides the transparency of an element in a given view

# group: Cuadro de Texto
description = Warning.Description(warning=getWarnings)
code_block_2 = CodeBlock(a=description, b=flatten) { a+ "  -  " +b; }
ꟿ_watchdialog = Custom[ꟿ WatchDialog](input=code_block_2)  # package spring nodes; This node that serializes the input information and presents it in a resizable text window.

# group: DESDE AQUÍ PUEDES SELECCIONAR EL ELEMENTO QUE DESEES VER Y TE ABRIRÁ UNA VISTA EN REVIT PARA MOSTRARTELO
watch = Watch(flatten)
