# Dynamo graph Warnings2.dyn (Dynamo 2.13.1.3887)
# packages: Crumple 2022.5.27, Clockwork for Dynamo 2.x 2.4.0, Rhythm 2023.2.2, Data-Shapes 2022.2.105

# group: Traer todos los warnings
traer_todos_los_errores = BoolSelector(false)  # graph input
current = Document.Current()
getWarnings = Warning.GetWarnings(document=current)

# group: Traer warnings por tipo
all_warnings_of_type = AllWarningsOfType()  # nothing selected; graph input
if_ = RefactoredIf(test=traer_todos_los_errores, true=getWarnings, false=all_warnings_of_type)
getFailingElements = Warning.GetFailingElements(warning=if_)

# group: Agrupar por tipo
description = Warning.Description(warning=if_)
groupByKey = List.GroupByKey(list=getFailingElements, keys=description)

# group: Filtrado de elementos visibles
all_elements_in_active_view = ElementsInView()
flatten = List.Flatten(list=groupByKey.groups)
contains = List.Contains(list=flatten@L2, item=all_elements_in_active_view, lacing=Longest)
filterByBoolMask = List.FilterByBoolMask(list=flatten, mask=contains)

# group: Modificar aquellos elementos que no fallan
code_block = CodeBlock { 41; 88; }
byARGB = Color.ByARGB(red=code_block.out0, green=code_block.out1, blue=code_block.out0)
fill_patterns = FillPatterns("<Relleno uniforme>")
code_block_2 = CodeBlock { 100; }
boolean = BoolSelector(true)
byProperties = Revit.Filter.OverrideGraphicSettings.ByProperties(projectionFillColor=byARGB, projectionLineColor=byARGB, projectionFillPattern=fill_patterns, transparency=code_block_2, halftone=boolean)
overrideInView = Element.OverrideInView(element=filterByBoolMask.out, overrides=byProperties)

# group: Crear rango de colores
color_palette = ColorPalette({R: 0, G: 255, B: 127, A: 255})
color_palette_2 = ColorPalette({R: 0, G: 0, B: 205, A: 255})
color_palette_3 = ColorPalette({R: 220, G: 20, B: 60, A: 255})
list_create = List.Create(item0=color_palette, item1=color_palette_2, item2=color_palette_3)
groupByKey_2 = List.GroupByKey(list=description, keys=description)
count = List.Count(list=groupByKey_2.uniqueKeys)
code_block_3 = CodeBlock(a=count) { [0,0.5,1]; 0..1..#a; }
color_range = ColorRange(colors=list_create, indices=code_block_3.out0, value=code_block_3.out1)

# group: Establecer colores de warnings
flow_waitfor = Custom[© Flow.WaitFor](data=groupByKey.groups, waitFor=overrideInView)  # package Crumple; Tells the first input to wait for the second input to arrive, then passes on the first input. Really useful for scripts which have branching paths that rely on their outputs to carry each other forward. Quite a few custom packages have a 'passthrough' or 'waitfor' node. I use these all the time, so find it useful to have them contained in this package also.
fill_patterns_2 = FillPatterns("<Relleno uniforme>")
byProperties_2 = Revit.Filter.OverrideGraphicSettings.ByProperties(projectionFillColor=color_range, projectionLineColor=color_range, projectionFillPattern=fill_patterns_2)
overrideInView_2 = Element.OverrideInView(element=flow_waitfor, overrides=byProperties_2)

# group: Resetear gráficos de elementos
flow_waitfor_2 = Custom[© Flow.WaitFor](data=all_elements_in_active_view, waitFor=overrideInView_2)
resetear_los_elementos = BoolSelector(false)  # "Resetear los elementos modificados"; graph input
ʳʰʸᵗʰᵐ_helpers_toggle = Rhythm.Helpers.Helpers.Toggle(obj=flow_waitfor_2, toggle=resetear_los_elementos)
activeView = Document.ActiveView(document=current)
resetElementOverrides = Custom[View.ResetElementOverrides](element=ʳʰʸᵗʰᵐ_helpers_toggle, view=activeView)  # package Clockwork for Dynamo 2.x; Resets all overrides for an element in a given view

code_block_4 = CodeBlock { "Lista de Warnings"; "Close"; 650; }
code_block_5 = CodeBlock { "Warnings"; }
count_2 = List.Count(list=groupByKey_2.groups@L2)
pieChart = Custom[PieChart](Chart_name=code_block_5, series=groupByKey_2.uniqueKeys, values=count_2, Chart_colors_optionnal=color_range)  # package Data-Shapes; PieChart
hacer_esquema = BoolSelector(false)  # graph input
multipleinputform = Custom[MultipleInputForm ++](Description_optional=code_block_4.out0, ButtonText_optional=code_block_4.out1, Inputs=pieChart, Toggle=hacer_esquema, Width_optional=code_block_4.out2)  # package Data-Shapes; Create a form with multiple inputs. see www.data-shapes.net for tutorials and infos!
