# Dynamo graph Filtros.dyn (Dynamo 2.13.1.3887)
# packages: Clockwork for Dynamo 2.x 2.4.0, Data-Shapes 2022.2.105, GenerativeDesign 2.0.10.0, Modelical 2022.6.15

# group: 1. Obtener todas las vistas del proyecto
categories = Categories("OST_Views")
all_elements_of_category = ElementsOfCategory(Category=categories)

# group: 2. Filtramos las vistas que sean null
isNull = Object.IsNull(object=all_elements_of_category)
filterByBoolMask = List.FilterByBoolMask(list=all_elements_of_category, mask=isNull)

# group: 3. Quitamos las plantillas
# note: Comprobamos si una vista es plantilla
isViewTemplate = View.IsViewTemplate(view=filterByBoolMask.out)
filterByBoolMask_2 = List.FilterByBoolMask(list=filterByBoolMask.out, mask=isViewTemplate)

# group: 4. Filtramos las vista para obtener aquellas que tienen filtros aplicados
# note: Filtramos las vistas que tengan filtros aplicados
usesViewFilters = Custom[View.UsesViewFilters](view=filterByBoolMask_2.out)  # package Clockwork for Dynamo 2.x; Checks if a given view has any view filters applied to it.
filterByBoolMask_3 = List.FilterByBoolMask(list=filterByBoolMask_2.out, mask=usesViewFilters)

# group: 5. Cargamos el desplegable con las vista disponibles usando UI
code_block = CodeBlock { "Selecciona la vista con filtros"; }
name = Element.Name(element=filterByBoolMask_3.in)
dropdown_data = Custom[DropDown Data](InputName=code_block, Keys=name, Values=filterByBoolMask_3.in)  # package Data-Shapes; Create data for DropDown input in UI.MultiInputForm ++ . Check out www.data-shapes.net for more infos.

# group: 6. Creando la lista de Vistas en el desplegable
code_block_2 = CodeBlock { "Selecciona las vistas para aplicar filtros"; 500; false; }
name_2 = Element.Name(element=filterByBoolMask_2.out)
listview_data = Custom[Listview Data](InputName=code_block_2.out0, Keys=name_2, Values=filterByBoolMask_2.out, Height_optionnal=code_block_2.out1, ShowId_optionnal=code_block_2.out2)  # package Data-Shapes; Create data for ListView input in UI.MultiInputForm ++ . Check out www.data-shapes.net for more infos.

# group: 7. Creación Desplegable
code_block_3 = CodeBlock { "Aplicar Filtros inluco aunque la vista tenga filtros aplicados"; "Aplicar"; "Cancelar"; 250; 600; }
list_create = List.Create(item0=dropdown_data, item1=listview_data)
boolean = BoolSelector(true)
multipleinputform = Custom[MultipleInputForm ++](Description_optional=code_block_3.out0, ButtonText_optional=code_block_3.out1, Inputs=list_create, Toggle=boolean, CancelButtonText_optional=code_block_3.out2, Width_optional=code_block_3.out4, LabelWidth_optional=code_block_3.out3)  # package Data-Shapes; Create a form with multiple inputs. see www.data-shapes.net for tutorials and infos!

# group: 8. Establecer Filtros
code_block_4 = CodeBlock(x=multipleinputform.User_Inputs) { x[0]; x[1]; }
filters = View.Filters(view=code_block_4.out0)
filterOverrides = View.FilterOverrides(view=code_block_4.out0, parameterFilter=filters)
setFilterOverrides = View.SetFilterOverrides(view=code_block_4.out1, parameterFilter=filters, overrides=filterOverrides)

# group: Información de los filtros de una vista
# Con esta serie de elementos podemos obtener los filtros de una vista.
# note: Seleccionamos la vista donde tenemos aplicados los filtros
views = Views("{3D}")
# note: Activamos o desactivamos
gate = Data.Gate(true, views)
# note: Sacamos los filtros
filters_2 = View.Filters(view=gate)
# note: Obtenemos el name del filter
name_3 = GlobalParameter.Name(globalParameter=filters_2)
# note: Mostramos los datos
watch = Watch(name_3)

# group: Copiamos los filtros de una vista a otra
# note: Vista Orginen (donde están los filtros)
views_2 = Views("{3D}")
# note: Vista Destino (donde vas a establecer los filtros)
views_3 = Views("Nivel 1")
# note: Creación de la lista
list_create_2 = List.Create(item0=views_2, item1=views_3)
# note: Interruptor
gate_2 = Data.Gate(true, list_create_2)
# note: Asignamos ambos valores en el Code Block de cara a trabajar con ellos
code_block_5 = CodeBlock(vista_origen=gate_2, vista_destino=gate_2) { vista_origen[0]; vista_destino[1]; }
# note: Usamos Modelical y hay que importar este paquete
copyAllFilters = Custom[View.CopyAllFilters](sourceView=code_block_5.out0, targetViews=code_block_5.out1)  # package Modelical; This node copies all the filters with their settings from a view to another one.
string_from_array = FromArray(array=code_block_5.out0)
