# Dynamo graph Reto_01_RocioSalazar.dyn (Dynamo 2.6.1.8786)

code_block = CodeBlock { "marca"=="EXTERIOR"; }
code_block_2 = CodeBlock { wall; }  # unwired: wall
all_elements_of_category = ElementsOfCategory(Category=code_block_2)
