# Dynamo graph Ejercicio01_Codeblocks.dyn (Dynamo 2.6.1.8786)

# group: 220_CodeBlocks
# note: Bloque de DLAP: Iniciación
# note: Dynamo generado por: Luisa Santamaría
# note: Packages utilizados: ninguno
# note: Qué hace este dynamo: Diversos ejercicios para practicar el nodo Code Block

# note: Ejercicio 1 _ Escribe el codeblock para hacer una lista de números que vaya del 1 al 84 saltando de 7 en 7.
code_block = CodeBlock { 1..84..7; }
# note: Ejercicio 2 _ Haz lo mismo para que vaya del 1 al 84 saltando con 7 divisiones.
# note: Seleccion Elementos Revit
# note: Reestructuración de listas
# note: Filtrado
# note: Volcado de información a Revit
# note: Introducción de texto
# note: Generación de Geometría
code_block_2 = CodeBlock { 1..84..#7; }
# note: Ejercicio 3 _ Escribe un texto cualquiera con codeblocks
# note: Volcado de modelado a Revit
# note: Generación de series de valores
code_block_3 = CodeBlock { "Es un texto de prueba"; }
# note: Ejecicio 5 _ Obtén el resultado de sumar el 2º bloque de codeblocks con el texto usando variables.
code_block_4 = CodeBlock(x=code_block_2, y=code_block_3) { x; y; x+y; }
# note: Ejercicio 4 _ Haz una curva por tres puntos y transfórmala en CodeBlocks
code_block_5 = CodeBlock { Point.ByCoordinates(0,5,10); }
# note: Texto (String)
code_block_6 = CodeBlock { "Hola"; }
# note: Número entero (integer)
code_block_7 = CodeBlock { 1; }
# note: Número decimal (Double)
code_block_8 = CodeBlock { 1.5; }
# note: Variable
code_block_9 = CodeBlock { n; }  # unwired: n
# note: Escritura en varias líneas
code_block_10 = CodeBlock { "Línea 1"; "Línea 2"; "Línea n"; }
# note: Listas
code_block_11 = CodeBlock { ["Lista 1","Lista 2", "Lista 3"]; }
code_block_12 = CodeBlock { 1..20; }
# note: Números booleanos
code_block_13 = CodeBlock { true; }
code_block_14 = CodeBlock { false; }
# note: Comparación:
# a==b
# a>=b
# a<=b
# a!=b (distinto)
code_block_15 = CodeBlock { 1..20; }
code_block_16 = CodeBlock { 18; }
code_block_17 = CodeBlock(a=code_block_15, b=code_block_16) { a>=b; }
code_block_18 = CodeBlock { a=1; b=2; c=5; }
# note: Operar
code_block_19 = CodeBlock(a=code_block_18.a, b=code_block_18.b, c=code_block_18.c) { a+b*c; }
