# Dynamo graph Solucion01_Codeblocks.dyn (Dynamo 2.6.1.8786)

# note: Introducción de texto
# note: Seleccion Elementos Revit
# note: Reestructuración de listas
# note: Filtrado
# note: Generación de Geometría
# note: Volcado de información a Revit
# note: Generación de series de valores
# note: Volcado de modelado a Revit

# group: 220_CodeBlocks_ER
# note: Bloque de DLAP: Iniciación
# note: Packages utilizados: ninguno
# note: Dynamo generado por: Luisa Santamaría
# note: Qué hace este dynamo: Resuelve el ejercicio propuesto 134_CodeBlocks

# group: Ejercicio 1 _ Escribe el codeblock para hacer una lista de números que vaya del 1 al 84 saltando de 7 en 7.
# note: Al escribir:
# 1..84
# le estamos indicando que queremos una lista de valores que se encontrarán entre esos dos números. Y para indicarle que los valores que queremos que genere sean de 7 en 7, le añadimos al final:
# ..7
code_block = CodeBlock { 1..84..7; }

# group: Ejercicio 2 _ Haz lo mismo para que vaya del 1 al 84 saltando con 7 divisiones.
# note: En este caso, los valores entre los que buscará siguen siendo los mismos:
# 1..84
# Para indicarle que, esta vez, lo que queremos es que tome los valores que resultan de dividir la lista en 7 fragmentos iguales, escibiremos al final:
# ..#8
code_block_2 = CodeBlock { 1..84..#8; }

# group: Ejercicio 3 _ Escribe un texto cualquiera con codeblocks
# note: Para incorporar un texto mediante Code Blocks hay que escribirlo entre comillas.
code_block_3 = CodeBlock { "un texto cualquiera"; }

# group: Ejercicio 5 _ Obten el resultado de sumar el 2º bloque de codeblocks con el texto usando variables.
# note: Para este ejercicio hay que indicar al nodo Code Block que debe sumarnos dos variables. Para ello basta con escribir:
# a+b
# Al salir del la edicion del nodo, automáticamente generará los dos inputs que precisa para realizarf la operación. Solo tenemos que indicarle de dónde debe tomar los valores de las variables a sumar. Y nos genera la lista de los valores ya unidos.
code_block_4 = CodeBlock(a=code_block_2, b=code_block_3) { a+b; }

# group: Ejercicio 4 _ Haz una curva por tres puntos y transfórmala en CodeBlocks
# note: BONUS _ También podemos generar los tres puntos por coordenadas y el arco desde el mismo Code Block, de modo que queda más limpia la programación.
code_block_5 = CodeBlock()
# ---------- code_block_5.designscript (4 lines) ----------
point1 = Autodesk.Point.ByCoordinates(0, 0, 0);
point2 = Autodesk.Point.ByCoordinates(0, 30, 0);
point3 = Autodesk.Point.ByCoordinates(30, 30, 0);
arc1 = Arc.ByThreePoints(point1, point2, point3);
# ----------------------------------------
# note: 2º _ Ahora generamos los tres puntos que necesitamos.
# Éste tomará como valor por defecto 0 si en alguno de sus inputs no indicamos un valor.
byCoordinates = Point.ByCoordinates()
# note: 1º _ Indicamos un valor para poder generar los tres puntos que necesitamos como input para el nodo Arc.ByThreePoints
# Podemos generar hasta 9 valores distintos, 3 inputs por cada punto.
code_block_6 = CodeBlock { 30; }
byCoordinates_2 = Point.ByCoordinates(y=code_block_6)
byCoordinates_3 = Point.ByCoordinates(x=code_block_6, y=code_block_6)
# note: 3º _ Este nodo permite crear, a partir de tres puntos, una curva.
byThreePoints = Arc.ByThreePoints(firstPoint=byCoordinates, secondPoint=byCoordinates_2, thirdPoint=byCoordinates_3)
# note: 4º _ Seleccionamos el nodo que queremos transformar a modo Code Block (que tenga el borde azul), y en cualquier punto del espacio de trabajo en blanco, click al botón derecho y seleccionamos la opción Nodo para Código.
code_block_7 = CodeBlock(point1=byCoordinates, point2=byCoordinates_2, point3=byCoordinates_3) { arc1 = Arc.ByThreePoints(point1, point2, point3); }
