# Dynamo graph 220_SeleccionElementosDeRevit.dyn (Dynamo 2.2.1.5175)

# note: Seleccion Elementos Revit
# note: Reestructuración de listas
# note: Filtrado
# note: Volcado de información a Revit
# note: Generación de series de valores
# note: Volcado de modelado a Revit

# group: 134_SeleccionElementosDeRevit_ER
# note: Bloque de DLAP: Iniciación
# note: Packages utilizados: ninguno
# note: Dynamo generado por: Luisa Santamaría
# note: Qué hace este dynamo: Diferentes modos de seleccionar elementos del modelo de Revit

# group: 1 _ Seleccionar un elemento del modelo
# note: Resultado final
select_model_element = DSModelElementSelection()  # 1 picked in the model; graph input
# note: Este nodo permite seleccionar UN ÚNICO ELEMENTO del modelo. Una vez está en el área de trabajo, solo hay que pulsar Seleccionar y, en el modelo de Revit, seleccionar lo que quieres.
# En el nodo saldrá entonces la categoría del elemento y, en verde, el identificador del mismo.
select_model_element_2 = DSModelElementSelection()  # nothing selected; graph input

# group: 2 _ Seleccionar varios elementos del modelo
# note: Resultado final
select_model_elements = DSModelElementsSelection()  # 24 picked in the model; graph input
# note: Introducción de texto
# note: Generación de Geometría
# note: Este nodo permite seleccionar VARIOS ELEMENTOS del modelo. Una vez está en el área de trabajo, solo hay que pulsar Seleccionar y, en el modelo de Revit, arrastrando en diagonal, seleccionar lo que quieres.
# En el nodo saldrá entonces la ID de todos los elementos seleccionados, y en la lista, saldrá la categoría de cada elemento y, en verde, el identificador del mismo.
select_model_elements_2 = DSModelElementsSelection()  # nothing selected; graph input

# group: 3_ Selección de todos los elementos de la misma categoría del modelo
# note: Esta selección de elementos se realiza mediante dos nodos ya que, en primer lugar hay que indicar a qué categoría pertenecen los elementos que queremos seleccionar del modelo, y, posteriormente indicarle que queremos seleccionarlos todos.
# note: 1º En el desplegable del nodo seleccionamos la categoría de los elementos a seleccionar
categories = Categories("OST_Doors")  # graph input
# note: 2º Y este nodo seleccionará todos los elementos, presentes en el modelo, pertenecientes a la categoría que le hemos indicado.
all_elements_of_category = ElementsOfCategory(Category=categories)

# group: 4 _ Selección de todos los elementos pertenecientes al mismo nivel del modelo
# note: Esta selección de elementos se realiza mediante dos nodos ya que, en primer lugar hay que indicar a qué nivel del proyecto perteneceán los elementos que queremos seleccionar del modelo, y, posteriormente indicarle que queremos seleccionarlos todos.
# note: 1º En el desplegable del nodo seleccionamos el nivel al que pertenecen los elementos a seleccionar
levels = Levels("Level 1")  # graph input
# note: 2º Y este nodo seleccionará todos los elementos, presentes en el modelo, pertenecientes al nivel que le hemos indicado.
all_elements_at_level = ElementsAtLevel(Level=levels)

# group: 5 _ Selección de todos los elementos de la misma familia del modelo
# note: 1º En el desplegable del nodo seleccionamos la familia a la que pertenecen los elementos a seleccionar
family_types = FamilyTypes("M_Door-Double-Flush_Panel:1800 x 2100mm")  # graph input
# note: Esta selección de elementos se realiza mediante dos nodos ya que, en primer lugar hay que indicar a qué familia pertenecerán los elementos que queremos seleccionar del modelo, y, posteriormente indicarle que queremos seleccionarlos todos.
# note: 2º Este nodo seleccionará todos los elementos, presentes en el modelo, pertenecientes a la familia que le hemos indicado.
all_elements_of_family_type = ElementsOfFamilyType(Family_Type=family_types)

# group: 6 _ Selección de todos los elementos de la vista activa que tengamos en ese instante del modelo
# note: Este nodo permite seleccionar todos los elementos de la vista activa en ese instante en el modelo. Una vez está en el área de trabajo, automáticamente toma la vista activa en ese momento.
all_elements_in_active_view = ElementsInView()  # graph input

# group: 7 _ Selección de la geometría de un conjunto de elementos
# note: Al utilizar el tipo de nodos All Elements at // All Elements of  estamos seleccionando los elementos y los mostrará como una lista de Identificadores. Si lo que buscamos es seleccionar la geometría de dichos elementos, hay que utilizar el nodo Element.Geometry. De este modo traerá a Dynano la geometría de todos aquellos elementos cuyo ID le proporcionemos como input
geometry = Element.Geometry(element=all_elements_in_active_view)

# group: 8 _ Selección de una cara de un elemento
# note: Resultado final
select_face = DSFaceSelection()  # 1 picked in the model; graph input
# note: Este nodo permite seleccionar, desde el modelo re Revit, la cara de un elemento. Al sacarlo al área de trabajo solo hay que presionar sobre seleccionar, y en Revit marcamos la cara del elemento que deseamos.
select_face_2 = DSFaceSelection()  # nothing selected; graph input
