# Dynamo graph Seleccion_Elementos_Teoria.dyn (Dynamo 2.13.1.3887)

# group: SELECCIÓN VARIOS ELEMENTOS
# note: Podemos seleccionar varios elementos en Revit, mediante una caja de selección (pulsando y arrastrando)
select_model_elements = DSModelElementsSelection()  # nothing selected

# group: SELECCIÓN 1 ELEMENTO
# note: Podemos seleccionar un elemento en Revit, de uno en uno.
select_model_elements_2 = DSModelElementsSelection()  # nothing selected

# group: SELECCIÓN POR NIVEL
# note: Selecciono todos los elementos que están en el nivel seleccionado.
levels = Levels()  # nothing selected
all_elements_at_level = ElementsAtLevel(Level=levels)

# group: SELECCIÓN POR CATEGORÍA
# note: Con este nodo podemos seleccionar por categorías, pero tenemos que tener en cuenta que una categoria alberga subcategorías, por ejemplo: muros (tienes muros, líneas de muro, materiales, líneas discontinuas, etc.). Por lo tanto, para seleccionar una categoría debemos filtrar y este nodo se usa en concordancia con "All Elements of Category".
categories = Categories("OST_Walls")
all_elements_of_category = ElementsOfCategory(Category=categories)

# note: No es muy recomendado, ya que necesitamos disponer de una vista activa ya preparada.
all_elements_in_active_view = ElementsInView()

# group: SELECCIÓN SEGÚN ELEMENTOS
# note: Seleccionamos todos los elementos de un mismo tipo
element_types = ElementTypes("Wall")
all_elements_of_type = ElementsOfType(element_type=element_types)

# group: SELECCIÓN SEGÚN FAMILIA
# note: Seleccionar todos los elementos de un tipo de familia.
family_types = FamilyTypes()  # nothing selected
all_elements_of_family_type = ElementsOfFamilyType(Family_Type=family_types)

# note: Este nodo lo necesito para visualizar lo seleccionado en dynamo
geometry = Element.Geometry()  # unwired: element
