# Dynamo graph 01_PasarDatos_Parametro_A_OtroParametro.dyn (Dynamo 2.6.1.8786)

categories = Categories("OST_Doors")
all_elements_of_category = ElementsOfCategory(Category=categories)
geometry = Element.Geometry(element=all_elements_of_category)
code_block = CodeBlock { "Marca"; }
code_block_2 = CodeBlock { "Comentarios"; }
getParameterValueByName = Element.GetParameterValueByName(element=all_elements_of_category, parameterName=code_block_2)
setParameterByName = Element.SetParameterByName(element=all_elements_of_category, parameterName=code_block, value=getParameterValueByName)
