# Dynamo graph 02_NombrarParametro_SegunOtro.dyn (Dynamo 2.6.1.8786)

categories = Categories("OST_Rooms")
all_elements_of_category = ElementsOfCategory(Category=categories)
code_block = CodeBlock { "Comentarios"; }
code_block_2 = CodeBlock { "Nombre"; }
getParameterValueByName = Element.GetParameterValueByName(element=all_elements_of_category, parameterName=code_block_2)
code_block_3 = CodeBlock { "Aseo"; }
contains = String.Contains(str=getParameterValueByName, searchFor=code_block_3)
filterByBoolMask = List.FilterByBoolMask(list=getParameterValueByName, mask=contains)
setParameterByName = Element.SetParameterByName(element=all_elements_of_category, parameterName=code_block, value=filterByBoolMask.in)
