# Dynamo graph 03_ElegirElemento_EscribirValorenParametro.dyn (Dynamo 2.6.1.8786)

# group: Seleccionamos categorías en el modelo
categories = Categories("OST_Rooms")
all_elements_of_category = ElementsOfCategory(Category=categories)

# group: Obtenemos el parametro elegido del elemento.
code_block = CodeBlock { "Nombre"; }
getParameterValueByName = Element.GetParameterValueByName(element=all_elements_of_category, parameterName=code_block)

# group: Preguntamos por un string y nos arroja un valor de si o no.
code_block_2 = CodeBlock { "Aseo"; }
contains = String.Contains(str=getParameterValueByName, searchFor=code_block_2)

# group: Filtramos los si, de los no
filterByBoolMask = List.FilterByBoolMask(list=all_elements_of_category, mask=contains)

# group: Pido el nombre de la habitación de los elementos out.
code_block_3 = CodeBlock { "Nombre"; }
getParameterValueByName_2 = Element.GetParameterValueByName(element=filterByBoolMask.out, parameterName=code_block_3)

# group: Pregunto, cual se llama cocina.
code_block_4 = CodeBlock { "Cocina"; }
contains_2 = String.Contains(str=getParameterValueByName_2, searchFor=code_block_4)

# group: Filtro
filterByBoolMask_2 = List.FilterByBoolMask(list=filterByBoolMask.out, mask=contains_2)

list_create = List.Create(item0=filterByBoolMask.in, item1=filterByBoolMask_2.in)

# group: Le digo que a los elementos de in (aseos), les escriba el valor "Cuarto húmedo", en el parámetro Comentarios.
code_block_5 = CodeBlock { "Comentarios"; "Cuarto húmedo"; }
setParameterByName = Element.SetParameterByName(element=list_create, parameterName=code_block_5.out0, value=code_block_5.out1)
