# Dynamo graph 04_NumerarElementos.dyn (Dynamo 2.6.1.8786)

# group: Buscamos todos los elementos en la vista activa. Y obtenemos su categoría.
all_elements_in_active_view = ElementsInView()
getCategory = Element.GetCategory(element=all_elements_in_active_view)

# group: Preguntamos cual de ellos es de la categoría Mobiliario
string_from_object = FromObject(obj=getCategory)
code_block = CodeBlock { "Mobiliario"; }
contains = String.Contains(str=string_from_object, searchFor=code_block)

# group: Filtramos
filterByBoolMask = List.FilterByBoolMask(list=all_elements_in_active_view, mask=contains)

# group: Preguntamos, cuales de los elementos mobiliario son M_Chair
string_from_object_2 = FromObject(obj=filterByBoolMask.in)
code_block_2 = CodeBlock { "M_Chair"; }
contains_2 = String.Contains(str=string_from_object_2, searchFor=code_block_2)

# group: Filtramos
filterByBoolMask_2 = List.FilterByBoolMask(list=filterByBoolMask.in, mask=contains_2)

# group: Le decimos que nos numere las sillas del 1 a n (número de elementos variable que se cuenta con el parámetro count), de 1 en 1.
code_block_3 = CodeBlock { "N_Silla"; }
count = List.Count(list=filterByBoolMask_2.in)
code_block_4 = CodeBlock(n=count) { 1..n..1; }
setParameterByName = Element.SetParameterByName(element=filterByBoolMask_2.in, parameterName=code_block_3, value=code_block_4)
