# Dynamo graph 05_Asignar2valores_A_MismoParametro.dyn (Dynamo 2.6.1.8786)

# note: Seleccion Elementos Revit
# note: Reestructuración de listas
# note: Introducción de texto
# note: Filtrado
# note: Generación de Geometría
# note: Volcado de información a Revit
# note: Transformaciones y operaciones con parámetros
# note: Generación de series de valores
# note: Operaciones en REVIT
# note: Extracción de valores de parámetros
# note: Volcado de modelado a Revit

# group: 220_NodosSurvivalKit2A_ER
# note: Dynamo generado por: Luisa Santamaría
# note: Bloque de DLAP: Iniciación
# note: Packages utilizados: ninguno
# note: Qué hace este dynamo: Resolución ejercicio propuesto en clase 2A

# group: 1º_Seleccionamos los elementos de la vista activa
all_elements_in_active_view = ElementsInView()  # graph input

# group: 2º_Filtramos todos los muros de entre los elementos seleccionados mediante la categoría de elemento
# note: English
code_block = CodeBlock { "Walls"; }
getCategory = Element.GetCategory(element=all_elements_in_active_view)
string_from_object = FromObject(obj=getCategory)
# note: Español
code_block_2 = CodeBlock { "Muros"; }
contains = String.Contains(str=string_from_object, searchFor=code_block_2)
filterByBoolMask = List.FilterByBoolMask(list=all_elements_in_active_view, mask=contains)

# group: 4º_Extraemos los valores de Longitud de los muros
# note: English
code_block_3 = CodeBlock { "Length"; }
# note: Español
code_block_4 = CodeBlock { "Longitud"; }
getParameterValueByName = Element.GetParameterValueByName(element=filterByBoolMask.in, parameterName=code_block_4)

# group: 3º_Contamos los muros y generamos la serie de números genérica (donde n será el numero de elementos contados)
count = List.Count(list=filterByBoolMask.in)
code_block_5 = CodeBlock(n=count) { 1..n..1; }

# group: 5º_Generamos los valores que incorporaremos al parámetro Comentarios
# note: Nº_Longitud
string_from_object_2 = FromObject(obj=code_block_5)
# note: RECORDATORIO: Para poder sumar cadenas de texto al menos uno de los elementos debe ser Cadena de Texto
code_block_6 = CodeBlock(a=string_from_object_2, b=getParameterValueByName) { a+"_"+b; }

# group: 6º_Asignamos el valor al parámetro "Comentarios"
# note: Español
code_block_7 = CodeBlock { "Comentarios"; }
setParameterByName = Element.SetParameterByName(element=filterByBoolMask.in, parameterName=code_block_7, value=code_block_6)
# note: English
code_block_8 = CodeBlock { "Comments"; }
