# Dynamo graph 220_NodosSurvivalKit1A.dyn (Dynamo 2.2.1.5175)

# note: Seleccion Elementos Revit
# note: Reestructuración de listas
# note: Filtrado
# note: Generación de Geometría
# note: Volcado de información a Revit
# note: Generación de series de valores
# note: Volcado de modelado a Revit
# note: Extracción de valores de parámetros

# group: 220_NodosSurvivalKit1A
# note: Bloque de DLAP: Iniciación
# note: Dynamo generado por: Luisa Santamaría
# note: Packages utilizados: ninguno
# note: Qué hace este dynamo: Rutinas generadas a lo largo de la clase 1A

# group: 1º_ Selección de todas las puertas del proyecto
categories = Categories("OST_Doors")  # graph input
# note: Introducción de texto
# note: Transformaciones y operaciones con parámetros
all_elements_of_category = ElementsOfCategory(Category=categories)

# group: 2º_ Extracción del parámetro Head Height / Altura de extremo inicial de las puertas
# note: Español
code_block = CodeBlock { "Altura de extremo inicial"; }
getParameterValueByName = Element.GetParameterValueByName(element=all_elements_of_category, parameterName=code_block)
# note: English
code_block_2 = CodeBlock { "Head Height"; }

# group: 3º_ Transformación de los valores de numero a texto
# note: Con este nodo transformamos los valores del parámetro (que son Longitud) a Texto (que es el tipo de valores que acepta el parámetro Comentarios
string_from_object = FromObject(obj=getParameterValueByName)

# group: 4º_ Indicamo qué valores queremos que aparezcan en el parámetro Comentarios de todas las puertas
# note: Español
code_block_3 = CodeBlock { "Comentarios"; }
setParameterByName = Element.SetParameterByName(element=all_elements_of_category, parameterName=code_block_3, value=string_from_object)
# note: English
code_block_4 = CodeBlock { "Comments"; }
