# Dynamo graph 220_NodosSurvivalKit1A_ER.dyn (Dynamo 2.2.1.5175)

# note: Introducción de texto
# note: Seleccion Elementos Revit
# note: Reestructuración de listas
# note: Filtrado
# note: Generación de Geometría
# note: Volcado de información a Revit
# note: Transformaciones y operaciones con parámetros
# note: Generación de series de valores
# note: Extracción de valores de parámetros
# note: Volcado de modelado a Revit

# group: 220_NodosSurvivalKit1A_ER
# note: Bloque de DLAP: Iniciación
# note: Dynamo generado por: Luisa Santamaría
# note: Packages utilizados: ninguno
# note: Qué hace este dynamo: Resolución de la rutina propuesta en la clase 1A

# group: 1º_ Seleccionamos todos los muros del proyecto
categories = Categories("OST_Walls")  # graph input
all_elements_of_category = ElementsOfCategory(Category=categories)

# group: 2º_ Extraemos los parámetro que necesitamos para generar los sumatorios
# note: English
code_block = CodeBlock { "Unconnected Height"; "Length"; }
getParameterValueByName = Element.GetParameterValueByName(element=all_elements_of_category, parameterName=code_block.out0)
getParameterValueByName_2 = Element.GetParameterValueByName(element=all_elements_of_category, parameterName=code_block.out1)
# note: Español
code_block_2 = CodeBlock { "Altura desconectada"; "Longitud"; }

# group: 3º_ Generamos los sumatorios de los valores de los parametros extraídos
# note: Con este nodo sumamos todos los valores obtenidos del parámetro Unconnected Height / Altura desconectada.
sum = Math.Sum(values=getParameterValueByName)
# note: Con este nodo estamos sumando todos los valores del parámetro Length / Longitud obtenidos
sum_2 = Math.Sum(values=getParameterValueByName_2)

# group: 4º_ Asociamos los sumatorios obtenidos a los parámetros de Altura y Longitud Totales
code_block_3 = CodeBlock { "AlturaTotal"; "LongTotal"; }
setParameterByName = Element.SetParameterByName(element=all_elements_of_category, parameterName=code_block_3.out0, value=sum)
setParameterByName_2 = Element.SetParameterByName(element=all_elements_of_category, parameterName=code_block_3.out1, value=sum_2)
