# Dynamo graph 220_NodosSurvivalKit1B.dyn (Dynamo 2.2.1.5175)

# note: Reestructuración de listas
# note: Seleccion Elementos Revit
# note: Filtrado
# note: Volcado de información a Revit
# note: Generación de series de valores
# note: Volcado de modelado a Revit

# group: 220_NodosSurvivalKit1B
# note: Dynamo generado por: Luisa Santamaría
# note: Bloque de DLAP: Iniciación
# note: Packages utilizados: ninguno
# note: Qué hace este dynamo: Rutinas generadas a lo largo de la clase 1B _ Asignación del valor "Cuarto Húmedo" al Parámetro de Proyecto que hemos generado "CuartoH"

# group: 1º_ Seleccionamos las habitaciones del modelo
# note: Rooms en caso de tener el Revit en Inglés
categories = Categories("OST_Rooms")  # graph input
# note: Introducción de texto
# note: Transformaciones y operaciones con parámetros
all_elements_of_category = ElementsOfCategory(Category=categories)

# group: 2º_ Extraemos los nombres de las habitaciones
# note: English
code_block = CodeBlock { "Name"; }
# note: Generación de Geometría
# note: Extracción de valores de parámetros
# note: El nodo anterior extrae las ID de las diferentes habitaciones del proyecto, pero queremos hacer un filtrado según el valor del parametro Nombre. Para ello, Debemos extraer el valor de dicho parámetro.
getParameterValueByName = Element.GetParameterValueByName(element=all_elements_of_category, parameterName=code_block)
# note: Español
code_block_2 = CodeBlock { "Nombre"; }

# group: 3º_ Filtramos las habitaciones por nombre, porque solo queremos las que se llamen Aseo
code_block_3 = CodeBlock { "Aseo"; }
# note: Con este nodo le estamos preguntando a las habitaciones si sus nombres contienen la palabra ASEO
contains = String.Contains(str=getParameterValueByName, searchFor=code_block_3)
# note: Con este nodo filtramos por True-False las respuestas de la pregunta anterior, y separamos unos de otros
filterByBoolMask = List.FilterByBoolMask(list=all_elements_of_category, mask=contains)

# group: 4º_ Extraemos los nombres de las habitaciones que no son Aseo
# note: English
code_block_4 = CodeBlock { "Name"; }
# note: De la lista de Habitaciones que hemos descartado por no contener en su nombre "Aseo", queremos extraer las que contengan "Cocina". Para ello Necesitamos extraer de nuevo los nombres de las Habitaciones
getParameterValueByName_2 = Element.GetParameterValueByName(element=filterByBoolMask.out, parameterName=code_block_4)
# note: Español
code_block_5 = CodeBlock { "Nombre"; }

# group: 5º_ Filtramos las habitaciones por nombre para seleccionar la Cocina
code_block_6 = CodeBlock { "Cocina"; }
contains_2 = String.Contains(str=getParameterValueByName_2, searchFor=code_block_6)
# note: Estamos repitiendo la operativa seguida para extraer las habitaciondes con nombre Aseo para extraer, en este caso, las habitaciones cuyo nombre sea Cocina
filterByBoolMask_2 = List.FilterByBoolMask(list=filterByBoolMask.out, mask=contains_2)

# group: 6º_ Generamos una lista con todas las habitaciones que son Cuartos Húmedos
# note: Debemos generar una lista con todas las habitaciones que queremos que contengan Cuarto Húmedo ya que el nodo para asignar valores a un parámetro determinado solo admite un input
create = List.Create(item0=filterByBoolMask.in, item1=filterByBoolMask_2.in)

# group: 7º_ Al parámetro de proyecto que hemos generado (CuartoH) le asignamos el valor que queremos.
code_block_7 = CodeBlock { "CuartoH"; "Cuarto Humedo"; }
setParameterByName = Element.SetParameterByName(element=create, parameterName=code_block_7.out0, value=code_block_7.out1)
