# Dynamo graph 220_NodosSurvivalKit1B_ER.dyn (Dynamo 2.6.1.8786)

# note: Extracción de valores de parámetros
# note: Reestructuración de listas
# note: Filtrado
# note: Generación de series de valores
# note: Seleccion Elementos Revit
# note: Volcado de información a Revit
# note: Volcado de modelado a Revit

# group: 220_NodosSurvivalKit1B_ER
# note: Qué hace este dynamo: Resolución de la rutina propuesta en la clase 1B
# note: Dynamo generado por: Luisa Santamaría
# note: Bloque de DLAP: Iniciación
# note: Packages utilizados: ninguno

# group: 1º_Seleccionamos todos los muros del modelo
categories = Categories("OST_Walls")  # graph input
all_elements_of_category = ElementsOfCategory(Category=categories)
# note: Transformaciones y operaciones con parámetros
# note: Introducción de texto
# note: Generación de Geometría
code_block = CodeBlock(muros=all_elements_of_category) { muros; }

# group: 2º_Extraemos de cada muro su tipo.
# note: Español
code_block_2 = CodeBlock { "Tipo"; }
getParameterValueByName = Element.GetParameterValueByName(element=code_block, parameterName=code_block_2)
# note: English
code_block_3 = CodeBlock { "Type"; }

# group: 3º_Filtramos y separamos los muros por tipo.
string_from_object = FromObject(obj=getParameterValueByName)
code_block_4 = CodeBlock { "2"; }
# note: Le estamos preguntando a la lista de muros por tipo si su nombre contiene un 2 (es decir, separamos los de 200 de los de 300 de esta forma)
contains = String.Contains(str=string_from_object, searchFor=code_block_4)
filterByBoolMask = List.FilterByBoolMask(list=code_block, mask=contains)
# note: Tipo 200
code_block_5 = CodeBlock(murosTipo200=filterByBoolMask.in) { murosTipo200; }
# note: Tipo 300
code_block_6 = CodeBlock(murosTipo300=filterByBoolMask.out) { murosTipo300; }

# group: 4º_Para cada tipo de muro, extraemos los valores de Unconnected Height/Altura desconectada, generamos el sumatorio de dichos valores y, el resultado lo asignamos como valor del parámetro AlturatotalPorTipo
code_block_7 = CodeBlock { "AlturatotalPorTipo"; }
# note: Español
code_block_8 = CodeBlock { "Altura desconectada"; }
# note: Tipo 200
getParameterValueByName_2 = Element.GetParameterValueByName(element=code_block_5, parameterName=code_block_8)
sum = Math.Sum(values=getParameterValueByName_2)
setParameterByName = Element.SetParameterByName(element=code_block_5, parameterName=code_block_7, value=sum)
# note: Tipo 300
getParameterValueByName_3 = Element.GetParameterValueByName(element=code_block_6, parameterName=code_block_8)
sum_2 = Math.Sum(values=getParameterValueByName_3)
setParameterByName_2 = Element.SetParameterByName(element=code_block_6, parameterName=code_block_7, value=sum_2)
# note: English
code_block_9 = CodeBlock { "Unconnected Height"; }

# group: 5º_Para cada tipo de muro, extraemos los valores de Length /Longitud, generamos el sumatorio de dichos valores y, el resultado lo asignamos como valor del parámetro LongTotalPorTipo
# note: English
code_block_10 = CodeBlock { "Length"; }
code_block_11 = CodeBlock { "LongTotalPorTipo"; }
# note: Español
code_block_12 = CodeBlock { "Longitud"; }
# note: Tipo 200
getParameterValueByName_4 = Element.GetParameterValueByName(element=code_block_5, parameterName=code_block_12)
sum_3 = Math.Sum(values=getParameterValueByName_4)
setParameterByName_3 = Element.SetParameterByName(element=code_block_5, parameterName=code_block_11, value=sum_3)
# note: Tipo 300
getParameterValueByName_5 = Element.GetParameterValueByName(element=code_block_6, parameterName=code_block_12)
sum_4 = Math.Sum(values=getParameterValueByName_5)
setParameterByName_4 = Element.SetParameterByName(element=code_block_6, parameterName=code_block_11, value=sum_4)
