# Dynamo graph EjercicioA.dyn (Dynamo 2.6.1.8786)

# group: Seleccionamos todos los muros del modelo
# note: EJERCICIO A:
# 1. Seleccionar todos los muros del modelo.
# 2. Conger información de longitud y altura.
# 3. Meter la suma de todas las longitudes en el parámetro longitud total y lo mismo con las alturas.
categories = Categories("OST_Walls")
all_elements_of_category = ElementsOfCategory(Category=categories)

# group: Cojo la información de ambos parámetros
code_block = CodeBlock { "Longitud"; }
getParameterValueByName = Element.GetParameterValueByName(element=all_elements_of_category, parameterName=code_block)
code_block_2 = CodeBlock { "Altura desconectada"; }
getParameterValueByName_2 = Element.GetParameterValueByName(element=all_elements_of_category, parameterName=code_block_2)

# group: Sumo los resultados y se los incorporo al parámetro designado.
code_block_3 = CodeBlock { "LongTotal"; }
sum = Math.Sum(values=getParameterValueByName)
setParameterByName = Element.SetParameterByName(element=all_elements_of_category, parameterName=code_block_3, value=sum)
code_block_4 = CodeBlock { "AlturaTotal"; }
sum_2 = Math.Sum(values=getParameterValueByName_2)
setParameterByName_2 = Element.SetParameterByName(element=all_elements_of_category, parameterName=code_block_4, value=sum_2)
