# Dynamo graph 220_NodosSurvivalKit2A.dyn (Dynamo 2.2.1.5175)

# note: Introducción de texto
# note: Seleccion Elementos Revit
# note: Reestructuración de listas
# note: Filtrado
# note: Transformaciones y operaciones con parámetros
# note: Generación de Geometría
# note: Volcado de información a Revit
# note: Generación de series de valores
# note: Extracción de valores de parámetros
# note: Volcado de modelado a Revit
# note: Operaciones en REVIT

# group: 220_NodosSurvivalKit2A
# note: Dynamo generado por: Luisa Santamaría
# note: Bloque de DLAP: Iniciación
# note: Packages utilizados: ninguno
# note: Qué hace este dynamo: Rutinas generadas a lo largo de la clase 2A

# group: 6º_EN REVIT creamos un Parámetro Compartido NSilla y lo añadimos al proyecto
# note: Parámetro Compartido:
# NSilla
#    * Disciplina:Común
#    * Tipo de parámetro: Número
# Lo añadimos al proyecto mediante Parámetros de Proyecto:
#    - Parámetro Compartido
#    * Nombre: NSilla
#    *Disciplina: Común
#    *Tipo: Número
#    *Agrupación: Otros
#    * Categoría: Mobiliario

# group: 1º_Seleccionamos todos los elementos de la vista activa
all_elements_in_active_view = ElementsInView()  # graph input

# group: 2º_Extraemos el valor de la categoría de cada elemento
getCategory = Element.GetCategory(element=all_elements_in_active_view)

# group: 3º_Filtramos los elementos seleccionados según la categoría Furniture/Mobiliario
# note: OJO! hay que darle una lista de textos, no de categorías. Por ello transformamos la lista de categorías
string_from_object = FromObject(obj=getCategory)
# note: English
code_block = CodeBlock { "Furniture"; }
contains = String.Contains(str=string_from_object, searchFor=code_block)
filterByBoolMask = List.FilterByBoolMask(list=all_elements_in_active_view, mask=contains)
# note: Español
code_block_2 = CodeBlock { "Mobiliario"; }

# group: 4º_Filtramos los elementos de mobiliario según si son silla o no.
string_from_object_2 = FromObject(obj=filterByBoolMask.in)
code_block_3 = CodeBlock { "Chair"; }
contains_2 = String.Contains(str=string_from_object_2, searchFor=code_block_3)
filterByBoolMask_2 = List.FilterByBoolMask(list=filterByBoolMask.in, mask=contains_2)

# group: 5º_Filtramos los elementos obtenidos silla según si contienen M_Chair o no
string_from_object_3 = FromObject(obj=filterByBoolMask_2.in)
code_block_4 = CodeBlock { "M_Chair"; }
# note: Porque queremos que solo las familias que contienen M_Chair se numeren
contains_3 = String.Contains(str=string_from_object_3, searchFor=code_block_4)
filterByBoolMask_3 = List.FilterByBoolMask(list=filterByBoolMask_2.in, mask=contains_3)

# group: 7º_Asignamos valores al parámetro que hemos generado.
code_block_5 = CodeBlock { "N_Silla"; }
# note: la lista de valores la hacemos genérica, para que la rutina pueda aplicarse a otros modelos, de forma que la variable n será el número de elementos que extraiga el nodo Count
count = List.Count(list=filterByBoolMask_3.in)
code_block_6 = CodeBlock(n=count) { 1..n..1; }
setParameterByName = Element.SetParameterByName(element=filterByBoolMask_3.in, parameterName=code_block_5, value=code_block_6)
