# Dynamo graph 220_NodosSurvivalKit2B.dyn (Dynamo 2.2.1.5175)

# note: Introducción de texto
# note: Seleccion Elementos Revit
# note: Reestructuración de listas
# note: Filtrado
# note: Transformaciones y operaciones con parámetros
# note: Generación de Geometría
# note: Volcado de información a Revit
# note: Generación de series de valores
# note: Extracción de valores de parámetros
# note: Volcado de modelado a Revit
# note: Operaciones en REVIT

# group: 220_NodosSurvivalKit2B
# note: Dynamo generado por: Luisa Santamaría
# note: Bloque de DLAP: Iniciación
# note: Packages utilizados: ninguno
# note: Qué hace este dynamo: Rutinas generadas a lo largo de la clase 2B

# group: 5º_EN REVIT creamos un Parámetro Compartido NSilla y lo añadimos al proyecto
# note: Parámetro Compartido:
# NSilla
#    * Disciplina:Común
#    * Tipo de parámetro: Número
# Lo añadimos al proyecto mediante Parámetros de Proyecto:
#    - Parámetro Compartido
#    * Nombre: NSilla
#    *Disciplina: Común
#    *Tipo: Número
#    *Agrupación: Otros
#    * Categoría: Mobiliario

# group: 15º_EN REVIT creamos un Parámetro Compartido NHab y lo añadimos al proyecto
# note: Parámetro Compartido:
# NHab
#    * Disciplina:Común
#    * Tipo de parámetro: Texto
# Lo añadimos al proyecto mediante Parámetros de Proyecto:
#    - Parámetro Compartido
#    * Nombre: NHab
#    *Disciplina: Común
#    *Tipo: Texto
#    *Agrupación: Otros
#    * Categoría: Mobiliario

# group: 1º_Seleccionamos todos los elementos de la vista activa
all_elements_in_active_view = ElementsInView()  # graph input

# group: 2º_Extraemos el valor de la categoría de cada elemento
getCategory = Element.GetCategory(element=all_elements_in_active_view)

# group: 3º_Filtramos los elementos seleccionados según la categoría Furniture/Mobiliario
# note: OJO! hay que darle una lista de textos, no de categorías. Por ello transformamos la lista de categorías
string_from_object = FromObject(obj=getCategory)
# note: English
code_block = CodeBlock { "Furniture"; }
contains = String.Contains(str=string_from_object, searchFor=code_block)
filterByBoolMask = List.FilterByBoolMask(list=all_elements_in_active_view, mask=contains)
# note: Español
code_block_2 = CodeBlock { "Mobiliario"; }

# group: 4º_Filtramos los elementos de mobiliario según si son silla o no.
string_from_object_2 = FromObject(obj=filterByBoolMask.in)
code_block_3 = CodeBlock { "Chair"; }
contains_2 = String.Contains(str=string_from_object_2, searchFor=code_block_3)
filterByBoolMask_2 = List.FilterByBoolMask(list=filterByBoolMask.in, mask=contains_2)

# group: 6º_Asignamos valores al parámetro que hemos generado.
code_block_4 = CodeBlock { "N_Silla"; }
# note: la lista de valores la hacemos genérica, para que la rutina pueda aplicarse a otros modelos, de forma que la variable n será el número de elementos que extraiga el nodo Count
count = List.Count(list=filterByBoolMask_2.in)
code_block_5 = CodeBlock(n=count) { 1..n..1; }
setParameterByName = Element.SetParameterByName(element=filterByBoolMask_2.in, parameterName=code_block_4, value=code_block_5)

# group: 7º_Extraemos los valores de localización de los elementos
getLocation = Element.GetLocation(element=setParameterByName)

# group: 8º_Asignamos los valores de localización de los elementos al parámetro Comentarios
# note: English
code_block_6 = CodeBlock { "Comments"; }
string_from_object_3 = FromObject(obj=getLocation)
setParameterByName_2 = Element.SetParameterByName(element=setParameterByName, parameterName=code_block_6, value=string_from_object_3)
# note: Español
code_block_7 = CodeBlock { "Comentarios"; }

# group: 9º_ Seleccionamos todas las habitaciones del modelo
categories = Categories("OST_Rooms")  # graph input
all_elements_of_category = ElementsOfCategory(Category=categories)

# group: 11º_
count_2 = List.Count(list=getLocation)
ofRepeatedItem = List.OfRepeatedItem(item=all_elements_of_category, amount=count_2)

# group: 10º_Comprobamos qué valores de localizacion se encuentran dentro de qué habitaciones
# note: Mediante Utilizar Niveles estamos indicando que compruebe si los elementos de la Lista 1 (los valores de localizacion de las sillas) están contenidos dentro de alguno de los elementos de la Lista 2 (las habitaciones). ["Preguntamos" a cada Localización si se encuntra en alguna de las habitaciones]
# Saca una Lista 3 en la que muestra, por cada Localización, la comprobación, en Verdadero/Falso, de si está contenida en cada una de las Habitaciones. [Cada Localización nos "responde" si está o no en cada una de las habitaciones]
# note: Lacing/Encaje: Más largo
isInsideRoom = Room.IsInsideRoom(room=all_elements_of_category@L2, point=getLocation@L1, lacing=Longest)

# group: 12º_Filtramos
filterByBoolMask_3 = List.FilterByBoolMask(list=ofRepeatedItem@L2, mask=isInsideRoom@L2)

# group: 13º_Aplanamos la Lista
# note: Consiste en crear una lista de un solo nivel a partir de una lista de varios niveles.
flatten = List.Flatten(list=filterByBoolMask_3.in)

# group: 14º_Extraemos el valor del parámetro nombre de la lista aplanada
# note: English
code_block_8 = CodeBlock { "Name"; }
getParameterValueByName = Element.GetParameterValueByName(element=flatten, parameterName=code_block_8)
# note: Español
code_block_9 = CodeBlock { "Nombre"; }

# group: 16º_ Asignamos al parámetro que hemos creado, NHab, el valor correspondiente (el nombre de la habitación a la que pertenece la Localización de cada elemento)
code_block_10 = CodeBlock { "NHab"; }
setParameterByName_3 = Element.SetParameterByName(element=setParameterByName, parameterName=code_block_10, value=getParameterValueByName)
