# Dynamo graph 220_Geometria 20-80_1.dyn (Dynamo 2.2.1.5175)

# note: Extracción de valores de parámetros
# note: Generación de Geometría
# note: Transformaciones y operaciones con parámetros
# note: Filtrado
# note: Generación de series de valores
# note: Introducción de texto
# note: Reestructuración de listas
# note: Seleccion Elementos Revit
# note: Volcado de información a Revit
# note: Volcado de modelado a Revit

# group: 220_Geometria 20-80 1
# note: Dynamo generado por: Luisa Santamaría
# note: Qué hace este dynamo: Rutinas generadas a lo largo de la clase
# note: Bloque de DLAP: Iniciación
# note: Packages utilizados: ninguno

# group: 1º_Nodos para generar valores de números
number = DoubleInput(4)  # graph input
code_block = CodeBlock { 4; }
number_slider = DoubleSlider(1300, range=0..10000 step 100)  # graph input
number_slider_2 = DoubleSlider(5200, range=0..10000 step 100)  # graph input
number_slider_3 = DoubleSlider(400, range=0..10000 step 100)  # graph input

# group: 2º_Nodos para generar puntos
byCoordinates = Point.ByCoordinates(x=number_slider, y=number_slider)
byCoordinates_2 = Point.ByCoordinates(y=number_slider_2)
byCoordinates_3 = Point.ByCoordinates(x=number_slider_3, y=number_slider_3)

# group: 3º_Nodo para generar Lineas
byStartPointEndPoint = Line.ByStartPointEndPoint(startPoint=byCoordinates, endPoint=byCoordinates_2)

# group: 4º_Nodo para extraer la longitud de una curva
# note: Operaciones en REVIT
# note: Operaciones con Geometría
length = Curve.Length(curve=byStartPointEndPoint)

# group: 5º_Subdivisión de una curva en fragmentos
code_block_2 = CodeBlock { 0..1..0.01; }
pointAtParameter = Curve.PointAtParameter(curve=byStartPointEndPoint, param=code_block_2)

# group: 6º_Extraer la longitud de cada una de las subdivisiones de la curva
segmentLengthAtParameter = Curve.SegmentLengthAtParameter(curve=byStartPointEndPoint, param=code_block_2)

# group: 7º_Crear un arco por 3 puntos
byThreePoints = Arc.ByThreePoints(firstPoint=byCoordinates, secondPoint=byCoordinates_3, thirdPoint=byCoordinates_2)

# group: 8º_Subdivisión de la curva en fragmentos
pointAtParameter_2 = Curve.PointAtParameter(curve=byThreePoints, param=code_block_2)
segmentLengthAtParameter_2 = Curve.SegmentLengthAtParameter(curve=byThreePoints, param=code_block_2)

# group: 1º_Generamos valores numéricos
number_slider_4 = DoubleSlider(2000, range=1000..2000 step 100)  # graph input
number_slider_5 = DoubleSlider(1500, range=1000..2000 step 100)  # graph input
number_slider_6 = DoubleSlider(1100, range=1000..2000 step 100)  # graph input
number_slider_7 = DoubleSlider(1300, range=1000..2000 step 100)  # graph input

# group: 2º_Generamos Puntos
byCoordinates_4 = Point.ByCoordinates(x=number_slider_4, y=number_slider_4)
byCoordinates_5 = Point.ByCoordinates(x=number_slider_5, y=number_slider_4)
byCoordinates_6 = Point.ByCoordinates(x=number_slider_6, y=number_slider_6)
byCoordinates_7 = Point.ByCoordinates(x=number_slider_7, y=number_slider_7)

# group: 3º_Generamos una lista con los puntos
create = List.Create(item0=byCoordinates_4, item1=byCoordinates_5, item2=byCoordinates_6, item3=byCoordinates_7)

# group: 4º_Nodo para generar Policurvas (union de diversos puntos con líneas rectas)
byPoints = PolyCurve.ByPoints(points=create)

# group: 5º_Nodos para generar Nurbs (Unión de diversos puntos con curvas suavizadas)
byPoints_2 = NurbsCurve.ByPoints(points=create)
byControlPoints = NurbsCurve.ByControlPoints(points=create)
