# Dynamo graph 220_Geometria 20-80_1_ER.dyn (Dynamo 2.2.1.5175)

# note: Filtrado
# note: Introducción de texto
# note: Reestructuración de listas
# note: Seleccion Elementos Revit
# note: Generación de Geometría
# note: Volcado de información a Revit
# note: Generación de series de valores
# note: Extracción de valores de parámetros
# note: Volcado de modelado a Revit

# group: 220_Geometria20-80-1_ER
# note: Dynamo generado por: Luisa Santamaría
# note: Bloque de DLAP: Iniciación
# note: Packages utilizados: ninguno
# note: Qué hace este dynamo: Ejercicio propuesto durante la clase.

# group: 1º_Generamos los números que utilizaremos para crear tres puntos
integer_slider = IntegerSlider(28, range=0..100 step 1)  # graph input
code_block = CodeBlock { 14; }

# group: 2º_Creamos tres puntos
# note: Transformaciones y operaciones con parámetros
byCoordinates = Point.ByCoordinates()
byCoordinates_2 = Point.ByCoordinates(x=integer_slider)
byCoordinates_3 = Point.ByCoordinates(y=code_block, z=code_block)

# group: 3º_Creamos una línea
# note: Operaciones en REVIT
# note: Operaciones con Geometría
byStartPointEndPoint = Line.ByStartPointEndPoint(startPoint=byCoordinates, endPoint=byCoordinates_2)

# group: 5º_Generamos el valor que servirá como número de veces a dividir las curvas
integer_slider_2 = IntegerSlider(41, range=0..100 step 1)  # graph input
code_block_2 = CodeBlock(n=integer_slider_2) { 0..1..#n; }

# group: 4º_Generamos un arco por tres puntos
byThreePoints = Arc.ByThreePoints(firstPoint=byCoordinates, secondPoint=byCoordinates_3, thirdPoint=byCoordinates_2)

# group: 6º_Dividimos ambas curvas en el mismo numero de segmentos
pointAtParameter = Curve.PointAtParameter(curve=byStartPointEndPoint, param=code_block_2)
pointAtParameter_2 = Curve.PointAtParameter(curve=byThreePoints, param=code_block_2)

# group: 7º_Unimos mediante líneas los puntos de división creados en ambas curvas
byStartPointEndPoint_2 = Line.ByStartPointEndPoint(startPoint=pointAtParameter, endPoint=pointAtParameter_2)
