# Dynamo graph 220_Geometria_20-80-2_3.dyn (Dynamo 2.2.1.5175)

# note: Operaciones con Geometría
# note: Operaciones en REVIT
# note: Generación de Geometría
# note: Extracción de valores de parámetros
# note: Transformaciones y operaciones con parámetros
# note: Introducción de texto
# note: Reestructuración de listas
# note: Generación de series de valores
# note: Filtrado
# note: Seleccion Elementos Revit
# note: Volcado de información a Revit
# note: Volcado de modelado a Revit

# group: 220_Geometria20-80-2_3
# note: Qué hace este dynamo: Ejercicio propuesto durante la clase_parte 3
# note: Dynamo generado por: Luisa Santamaría
# note: Packages utilizados: ninguno
# note: Bloque de DLAP: Iniciación

# group: 1º_Seleccionamos los elementos del modelo
select_model_element = DSModelElementSelection()  # 1 picked in the model; graph input
select_model_elements = DSModelElementsSelection()  # 20 picked in the model; graph input

# group: 2º_ Extraemos la geometría de los elementos seleccionados
geometry = Element.Geometry(element=select_model_element)
geometry_2 = Element.Geometry(element=select_model_elements)

# group: 3º_Extruimos la Nurbs en la dirección normal al plano que la contiene
normal = Curve.Normal(curve=geometry)
code_block = CodeBlock { -50000; }
extrude = Curve.Extrude(curve=geometry, direction=normal, distance=code_block)

# note: Aplanamos la lista para poder verla más claramente, pero no es necesario para los pasos posteriores
flatten = List.Flatten(list=geometry_2)

# group: 4º_Extruimos las líneas para generar planos que intrsecten con la Nurbs extruida
ZAxis = Vector.ZAxis()
code_block_2 = CodeBlock { 25000; }
extrude_2 = Curve.Extrude(curve=flatten, direction=ZAxis, distance=code_block_2)

# group: 5º_Extraemos las intersecciones que generasn las extrusiones
# note: Encaje / Lacing: largo
intersect = Geometry.Intersect(geometry=extrude, other=extrude_2, lacing=Longest)

flatten_2 = List.Flatten(list=intersect)

# group: 3ºb_Generamos traslaciones de la Nurbs en dirección normal al plano que la contiene n veces
reverse = Vector.Reverse(vector=normal)
number_slider = DoubleSlider(50000, range=0..50000 step 0.1)  # graph input
integer_slider = IntegerSlider(21, range=0..100 step 1)  # graph input
code_block_3 = CodeBlock(n=number_slider, b=integer_slider) { 0..n..#b; }
translate = Geometry.Translate(geometry=geometry, direction=reverse, distance=code_block_3, lacing=Longest)

# group: 4ºb_Extruimos cada nurbs generada de forma que se crea un plano vertical por cada una de ellas
# note: Encaje / Lacing: largo
code_block_4 = CodeBlock { 300; }
extrude_3 = Curve.Extrude(curve=translate, distance=code_block_4)

# group: 5ºb_Damos grosor a cada uno de los planos generados, creando una volumetría por cada Nurbs
code_block_5 = CodeBlock { 250; }
thicken = Surface.Thicken(surface=extrude_3, thickness=code_block_5)

# group: 6º_Volcamos la geometría creada al modelo de Revit
categories = Categories("OST_GenericModel")  # graph input
byGeometry = DirectShape.ByGeometry(geometry=thicken, category=categories)

# group: 7º_Generamos unas líneas transversales a las Nurbs.
code_block_6 = CodeBlock { 0..1..#20; }
# note: Encaje / Lacing: largo
pointAtParameter = Curve.PointAtParameter(curve=geometry, param=code_block_6, lacing=Longest)
byStartPointDirectionLength = Line.ByStartPointDirectionLength(startPoint=pointAtParameter, direction=reverse, length=number_slider, lacing=Longest)

# group: 8º_Extruimos las líneas en la direccion Z
code_block_7 = CodeBlock { 90; }
extrude_4 = Curve.Extrude(curve=byStartPointDirectionLength, distance=code_block_7)

# group: 9º_Damos grosor a los planos generados
code_block_8 = CodeBlock { 150; }
thicken_2 = Surface.Thicken(surface=extrude_4, thickness=code_block_8)

# group: 10º_Volcamos la geometría creada al modelo de Revit
categories_2 = Categories("OST_GenericModel")  # graph input
byGeometry_2 = DirectShape.ByGeometry(geometry=thicken_2, category=categories_2)
