# Dynamo graph Ejercicio_Geometria_01_Peineta.dyn (Dynamo 2.6.1.8786)

byCoordinates = Point.ByCoordinates()
number_slider = DoubleSlider(20, range=0..100 step 1)
byCoordinates_2 = Point.ByCoordinates(y=number_slider)
byStartPointEndPoint = Line.ByStartPointEndPoint(startPoint=byCoordinates, endPoint=byCoordinates_2)
code_block = CodeBlock { 0..1..0.1; }
pointAtParameter = Curve.PointAtParameter(curve=byStartPointEndPoint, param=code_block)
number_slider_2 = DoubleSlider(15, range=0..100 step 1)
byCoordinates_3 = Point.ByCoordinates(x=number_slider_2, y=number_slider_2)
byThreePoints = Arc.ByThreePoints(firstPoint=byCoordinates, secondPoint=byCoordinates_3, thirdPoint=byCoordinates_2)
code_block_2 = CodeBlock { 0..1..0.1; }
pointAtParameter_2 = Curve.PointAtParameter(curve=byThreePoints, param=code_block_2)
byStartPointEndPoint_2 = Line.ByStartPointEndPoint(startPoint=pointAtParameter, endPoint=pointAtParameter_2)
