# Dynamo graph 220_Lacing.dyn (Dynamo 2.2.1.5175)

# note: Reestructuración de listas
# note: Seleccion Elementos Revit
# note: Filtrado
# note: Volcado de información a Revit
# note: Generación de series de valores
# note: Volcado de modelado a Revit

# group: 220_Lacing
# note: Dynamo generado por: Luisa Santamaría
# note: Bloque de DLAP: Iniciación
# note: Qué hace este dynamo: Rutina generada durante la clase
# note: Packages utilizados: ninguno

# group: 1º_Selección de todos los muros del modelo
categories = Categories("OST_Walls")  # graph input
# note: Introducción de texto
# note: Transformaciones y operaciones con parámetros
all_elements_of_category = ElementsOfCategory(Category=categories)

# group: 2º_Extraemos la geometría y el centro de los muros
# note: Generación de Geometría
geometry = Element.Geometry(element=all_elements_of_category)
# note: Operaciones en REVIT
# note: Extracción de valores de parámetros
# note: Operaciones con Geometría
flatten = List.Flatten(list=geometry)
centroid = Solid.Centroid(solid=flatten)

# group: 3º_ seleccionamos todos los pilares del modelo
categories_2 = Categories("OST_Columns")  # graph input
all_elements_of_category_2 = ElementsOfCategory(Category=categories_2)

# group: 4º_ Tomamos la localización de cada pilar
getLocation = Element.GetLocation(element=all_elements_of_category_2)

# group: 5º_Extraemos, una a una, la localización de los pilares
code_block = CodeBlock(i=getLocation) { i[0]; }
code_block_2 = CodeBlock(i=getLocation) { i[1]; }
code_block_3 = CodeBlock(i=getLocation) { i[2]; }

# group: 6º_Sacamos la distancia desde cada centro de muro a cada uno de los pilares
distanceTo = Geometry.DistanceTo(geometry=centroid, other=code_block)
distanceTo_2 = Geometry.DistanceTo(geometry=centroid, other=code_block_2)
distanceTo_3 = Geometry.DistanceTo(geometry=centroid, other=code_block_3)

# group: 7º_ Sacamos la distancia de cada uno de los centros de los muros a cada pilar mediante Lacing: Producto Vectorial
distanceTo_4 = Geometry.DistanceTo(geometry=centroid, other=getLocation, lacing=CrossProduct)

# group: APUNTE_TIPOS DE LACING/ENCAJE
# note: SHORTEST / MÁS CORTO
# Genera ujna lista con el mismo numero de elementos que la lista más corta que tenga como input ( I )
distanceTo_5 = Geometry.DistanceTo(geometry=centroid, other=getLocation)
# note: LONGEST / MÁS LARGO
# Genera una lista con el mismo numero de elementos que la lista más larga que tenga como input ( II\ )
distanceTo_6 = Geometry.DistanceTo(geometry=centroid, other=getLocation, lacing=Longest)
# note: CROSS PRODUCT / PRODUCTO VECTORIAL
# Si, como input, le damos dos listas, una de 7 elementos y una de 3 elementos, genera una lista única de tres niveles que contiene 7 listas de 3 elementos cada una ( XXX )
distanceTo_7 = Geometry.DistanceTo(geometry=centroid, other=getLocation, lacing=CrossProduct)
