# Dynamo graph 220_Lacing_ER.dyn (Dynamo 2.2.1.5175)

# note: Introducción de texto
# note: Reestructuración de listas
# note: Seleccion Elementos Revit
# note: Filtrado
# note: Generación de Geometría
# note: Volcado de información a Revit
# note: Generación de series de valores
# note: Extracción de valores de parámetros
# note: Volcado de modelado a Revit

# group: 220_Lacing_ER
# note: Bloque de DLAP: Iniciación
# note: Dynamo generado por: Luisa Santamaría
# note: Packages utilizados: ninguno
# note: Qué hace este dynamo: Ejercicio propuesto durante la clase

# group: 1º_Generamos los valores para crear la malla de puntos y el punto que se mueve
code_block = CodeBlock { 0..100..#10; }
number_slider = DoubleSlider(67.6, range=0..100 step 0.1)  # graph input
number_slider_2 = DoubleSlider(58, range=0..100 step 0.1)  # graph input

# group: 2º_Generamos la malla de puntos y el punto en movimiento
# note: Transformaciones y operaciones con parámetros
byCoordinates = Point.ByCoordinates(x=code_block, y=code_block, lacing=CrossProduct)
byCoordinates_2 = Point.ByCoordinates(x=number_slider, y=number_slider_2)

# group: 3º_Aplanamos la lista de puntos de la malla
# note: Operaciones en REVIT
# note: Operaciones con Geometría
flatten = List.Flatten(list=byCoordinates)

# group: 4º_Buscamos las distancias entre el punto en movimiento y cada uno de los puntos de la malla
distanceTo = Geometry.DistanceTo(geometry=byCoordinates_2, other=flatten)

# group: 5º_Mediante operaciones con la distancia entre los puntos de la malla y la distancia entre cada punto de la malla y el punto que se despaza obtenemos una lista de radios
code_block_2 = CodeBlock(i=code_block) { i[1]/2; }
maximumItem = List.MaximumItem(list=distanceTo)
code_block_3 = CodeBlock(dist=distanceTo, i=code_block_2, max=maximumItem) { r=(dist*(i/max)); }

# group: 6º_Generamos los círculos a partir de la malla de puntos y la distancia extraída
byCenterPointRadius = Circle.ByCenterPointRadius(centerPoint=flatten, radius=code_block_3)
