# Dynamo graph Ejercicio_Lacing.dyn (Dynamo 2.6.1.8786)

# note: Obtengo el valor máximo de la lista de distancia entre el punto movil y la malla.

# note: EJERCICIO LACING:
# 1. Dibujar una malla de puntos plana.
# 2. Dibujar un punto que se pueda deslizar por la malla de puntos.
# 3. Según muevo el punto de sitio, los circulos que están más cerca reducen su radio a 0, y los círculos que están más lejos amplian su radio a la distancia media entre dos puntos.
# note: Lo copio a una distancia de 1, 10 veces.
code_block = CodeBlock { 0..10..#10; }
# note: Genero un punto en el origen de coordenadas
byCoordinates = Point.ByCoordinates(x=code_block, y=code_block, lacing=CrossProduct)
number_slider = DoubleSlider(3, range=0..9 step 0.5)
number_slider_2 = DoubleSlider(3, range=0..9 step 0.5)
# note: Genero el punto que voy a desplazar.
byCoordinates_2 = Point.ByCoordinates(x=number_slider, y=number_slider_2)
# note: Busco la distancia entre el punto y la malla.
distanceTo = Geometry.DistanceTo(geometry=byCoordinates, other=byCoordinates_2)
# note: Distancia entre dos puntos de la malla partida por dos, para generar el radio máximo.
code_block_2 = CodeBlock(i=code_block) { i[1]/2; }
maximumItem = List.MaximumItem(list=distanceTo)
code_block_3 = CodeBlock(dist=distanceTo, i=code_block_2, max=maximumItem) { radio=(dist*(i/max)); }
byCenterPointRadius = Circle.ByCenterPointRadius(centerPoint=byCoordinates, radius=code_block_3)
