# Dynamo graph Teoria_Lacing_01.dyn (Dynamo 2.6.1.8786)

# note: Seleccionamos las columnas
categories = Categories("OST_Columns")
all_elements_of_category = ElementsOfCategory(Category=categories)
# note: La lista tiene tres niveles
# note: Obtenemos la localización de cada elemento
getLocation = Element.GetLocation(element=all_elements_of_category)
# note: Elegimos la fila 1
code_block = CodeBlock(i=getLocation) { i[0]; }
# note: Seleccionamos los muros
categories_2 = Categories("OST_Walls")
all_elements_of_category_2 = ElementsOfCategory(Category=categories_2)
# note: Nos traemos la geometría a Dynamo
geometry = Element.Geometry(element=all_elements_of_category_2)
# note: Aplanamos la lista
flatten = List.Flatten(list=geometry)
# note: Obtengo el centroide de todos los muros
centroid = Solid.Centroid(solid=flatten)
distanceTo = Geometry.DistanceTo(geometry=centroid, other=getLocation, lacing=CrossProduct)
