# Dynamo graph 220_Niveles2.dyn (Dynamo 2.2.1.5175)

# note: Reestructuración de listas
# note: Seleccion Elementos Revit
# note: Filtrado
# note: Volcado de información a Revit
# note: Generación de series de valores
# note: Volcado de modelado a Revit

# group: 220_Niveles2
# note: Dynamo generado por: Luisa Santamaría
# note: Bloque de DLAP: Iniciación
# note: Qué hace este dynamo: rutina generada durante la clase
# note: Packages utilizados: ninguno

# group: 1º_Selección de todos los muros del modelo
categories = Categories("OST_Walls")  # graph input
# note: Introducción de texto
# note: Transformaciones y operaciones con parámetros
all_elements_of_category = ElementsOfCategory(Category=categories)

# group: 2º_Extraemos la geometría y el centro de los muros
# note: Generación de Geometría
geometry = Element.Geometry(element=all_elements_of_category)
# note: Operaciones en REVIT
# note: Extracción de valores de parámetros
# note: Operaciones con Geometría
flatten = List.Flatten(list=geometry)
centroid = Solid.Centroid(solid=flatten)

# group: 3º_ seleccionamos todos los pilares del modelo
categories_2 = Categories("OST_Columns")  # graph input
all_elements_of_category_2 = ElementsOfCategory(Category=categories_2)

# group: 4º_ Tomamos la localización de cada pilar
getLocation = Element.GetLocation(element=all_elements_of_category_2)

# group: 5º_Extraemos, una a una, la localización de los pilares
code_block = CodeBlock(i=getLocation) { i[0]; }
code_block_2 = CodeBlock(i=getLocation) { i[1]; }
code_block_3 = CodeBlock(i=getLocation) { i[2]; }

# group: 6º_Sacamos la distancia desde cada centro de muro a cada uno de los pilares
distanceTo = Geometry.DistanceTo(geometry=centroid, other=code_block)
distanceTo_2 = Geometry.DistanceTo(geometry=centroid, other=code_block_2)
distanceTo_3 = Geometry.DistanceTo(geometry=centroid, other=code_block_3)

# group: 7º_ Sacamos la distancia de cada uno de los centros de los muros a cada pilar mediante Lacing: Producto Vectorial
distanceTo_4 = Geometry.DistanceTo(geometry=centroid, other=getLocation, lacing=CrossProduct)

# group: 8º_Ordenamos la lista de forma que cada conjunto del nivel 3 esté de menos a mayor valor
sort = List.Sort(list=distanceTo_4@L2)

# group: 9º_Al ordenar hemos perdido la referencia de índice de cada distancia
indexOf = List.IndexOf(list=distanceTo_4@L2, element=sort@L1, lacing=CrossProduct)
code_block_4 = CodeBlock { -1; }
eq = indexOf == code_block_4

# group: 10º_La lista OUT nos indica qué índice tenía cada valor antes haberlos reordenado
filterByBoolMask = List.FilterByBoolMask(list=indexOf, mask=eq)
