# Dynamo graph 220_Niveles_ER.dyn (Dynamo 2.2.1.5175)

# note: Seleccion Elementos Revit
# note: Volcado de información a Revit
# note: Volcado de modelado a Revit

# group: 220_Niveles_ER
# note: Dynamo generado por: Luisa Santamaría
# note: Bloque de DLAP: Intermedio
# note: Packages utilizados: ninguno
# note: Qué hace este dynamo: ejercicio propuesto durante la clase

# group: 1º_Seleccionamos los elementos del modelo
categories = Categories("OST_Walls")  # graph input
all_elements_of_category = ElementsOfCategory(Category=categories)
categories_2 = Categories("OST_Doors")  # graph input
all_elements_of_category_2 = ElementsOfCategory(Category=categories_2)

# group: 2º_Extraemos el punto medio de cada uno de los muros
# note: Introducción de texto
# note: Reestructuración de listas
# note: Filtrado
# note: Generación de Geometría
# note: Transformaciones y operaciones con parámetros
geometry = Element.Geometry(element=all_elements_of_category)
# note: Operaciones en REVIT
# note: Generación de series de valores
# note: Extracción de valores de parámetros
# note: Operaciones con Geometría
flatten = List.Flatten(list=geometry)
centroid = Solid.Centroid(solid=flatten)

# group: 3º_Extraemos la posición de las puertas
getLocation = Element.GetLocation(element=all_elements_of_category_2)

# group: 4º_Sacamos la distancia de cada puerta hasta cada muro
distanceTo = Geometry.DistanceTo(geometry=centroid, other=getLocation, lacing=CrossProduct)

# group: 5º_Ordenamos las distancias de mayor a menor dentro de cada Nivel 2
sort = List.Sort(list=distanceTo@L2)
reverse = List.Reverse(list=sort@L2)

# group: 6º_Al ordenar las distancias no sabemos identificar cuál era, necesitamos una lista que nos indique en qué indice se encontraban
indexOf = List.IndexOf(list=distanceTo@@L2, element=reverse@L1, lacing=CrossProduct)
code_block = CodeBlock { -1; }
eq = indexOf == code_block
filterByBoolMask = List.FilterByBoolMask(list=indexOf, mask=eq)
watch = Watch(filterByBoolMask.out)
