# Dynamo graph AccionesConListas_201.dyn (Dynamo 2.13.1.3887)

# note: Built In
# note: Core.List
# note: Leyenda: De más a menos utilizadas
# note: Más utilizadas
# note: Medio utilizadas
# note: Poco utilizadas

# group: Diccionarios
# note: Dictionaries (Diccionarios: con claves y valores)

# group: Contar
# note: Count (contar)

# group: Matriz
# note: Matrix (Matricialidad: jugar con la profundidad, diagonalidad, etc)

# group: Agrupar
# note: Group (Agrupar)

# group: Desagrupar
# note: Ungroup (Desagrupar)

# group: Insertar
# note: Insert (insertar)

# group: Ordenar
# note: Sort (ordenar)

# group: Eliminar
# note: Remove (eliminar)

# group: Comprobar
# note: Check (Comprobar)
# La respuesta de estas es un booleano

# group: Escoger
# note: Pick (Escoger)

# group: Crear
# note: Core + List Create (Crear)

# group: Reemplazarar
# note: Insert (insertar)

# group: Repetir
# note: Repeat (repetir)

# group: Agrupar
# note: Group (Agrupar)

# group: Desagrupar
# note: Ungroup (Desagrupar)

# group: Comprobar
# note: Check (Comprobar)
# La respuesta de estas es un booleano

# group: Crear
# note: Core + List Create (Crear)

# group: Contar
# note: Count (contar)

# group: Agrupar
# note: Group (Agrupar)

# group: Comprobar
# note: Check (Comprobar)
# La respuesta de estas es un booleano

# group: Desagrupar
# note: Ungroup (Desagrupar)

# group: Crear
# note: Core + List Create (Crear)

# group: Contar
# note: Count (contar)

# group: Repetir
# note: Repeat (repetir)

# group: Matriz
# note: Matrix (Matricialidad: jugar con la profundidad, diagonalidad, etc)

# group: Reemplazarar
# note: Insert (insertar)

# group: Diccionarios
# note: Dictionaries (Diccionarios: con claves y valores)

# group: Insertar
# note: Insert (insertar)

# group: Eliminar
# note: Remove (eliminar)

# group: Escoger
# note: Pick (Escoger)

# group: Ordenar
# note: Sort (ordenar)

# group: Ordenar
# note: Sort (ordenar)

# group: Repetir
# note: Repeat (repetir)

# group: Matriz
# note: Matrix (Matricialidad: jugar con la profundidad, diagonalidad, etc)

# group: Diccionarios
# note: Dictionaries (Diccionarios: con claves y valores)

# group: Eliminar
# note: Remove (eliminar)

# group: Reemplazarar
# note: Insert (insertar)

# group: Insertar
# note: Insert (insertar)

# group: Escoger
# note: Pick (Escoger)

# group: Explicación del dynamo
# note: Creadora: Luisa Santamaría
# note: Fecha: 20181027
# note: Versión de Dynamo 2.0.1
# note: Packages utilizados:
# note: Para qué sirve: descripción de todas las operaciones con listas que Dynamo trae en el Core y el Built.In
# note: Lunchbox.
# note: Rhythm.
# note: Clockwork.

# group: Más utilizadas
code_block = CodeBlock { ["1",1,"a","a","b"]; }
code_block_2 = CodeBlock { [2,1,1..4]; }
code_block_3 = CodeBlock { 5..170..~17; }
# note: Built In
create = List.Create(item0=code_block, item1=code_block_2, item2=code_block_3)
watch = Watch(create)
code_block_4 = CodeBlock { ["1",1,"a","a","b"]; }
code_block_5 = CodeBlock { [2,1,1..4]; }
code_block_6 = CodeBlock { 5..170..~17; }
# note: Core.List
join = List.Join(list0=code_block_4, list1=code_block_5, list2=code_block_6)
watch_2 = Watch(join)
code_block_7 = CodeBlock { "a"; }
contains = List.Contains(list=create, item=code_block_7)
watch_3 = Watch(contains)
code_block_8 = CodeBlock { []; }
isEmpty = List.IsEmpty(list=code_block_8)
watch_4 = Watch(isEmpty)
code_block_9 = CodeBlock { [[true,false],false]; }
count = List.Count(list=code_block_9)
watch_5 = Watch(count)
code_block_10 = CodeBlock { [[true,false],false]; }
countFalse = List.CountFalse(list=code_block_10)
watch_6 = Watch(countFalse)
code_block_11 = CodeBlock { [[true,true,false],false]; }
countTrue = List.CountTrue(list=code_block_11)
watch_7 = Watch(countTrue)
code_block_12 = CodeBlock { [[true,true,false],false]; }
count_2 = List.Count(list=code_block_12)
watch_8 = Watch(count_2)
code_block_13 = CodeBlock { ["1",1,"a","a","b"]; }
type = Object.Type()  # unwired: object
groupByFunction = List.GroupByFunction(list=code_block_13, groupFunction=type)
watch_9 = Watch(groupByFunction)
code_block_14 = CodeBlock()
# ---------- code_block_14.designscript (2 lines) ----------
["1",1,"a","a","b","Dumbledore"
, "yo", 123, 20, 3, 77];
# ----------------------------------------
code_block_15 = CodeBlock()
# ---------- code_block_15.designscript (3 lines) ----------
[1,
4,
2];
# ----------------------------------------
chop = List.Chop(list=code_block_14, lengths=code_block_15)
watch_10 = Watch(chop)
code_block_16 = CodeBlock()  # same code as code_block_14
code_block_17 = CodeBlock { 1; 7; 2; }
slice = List.Slice(list=code_block_16, start=code_block_17.out0, end=code_block_17.out1, step=code_block_17.out2)
watch_11 = Watch(slice)
code_block_18 = CodeBlock()  # same code as code_block_14
string_from_object = FromObject(obj=code_block_18)
length = String.Length(string=string_from_object)
code_block_19 = CodeBlock { 2; }
le = length <= code_block_19
filterByBoolMask = List.FilterByBoolMask(list=code_block_18, mask=le)
watch_12 = Watch(filterByBoolMask.in)
watch_13 = Watch(filterByBoolMask.out)
code_block_20 = CodeBlock()  # same code as code_block_14
sort = List.Sort(list=code_block_20)
watch_14 = Watch(sort)
code_block_21 = CodeBlock()  # same code as code_block_14
reverse = List.Reverse(list=code_block_21)
watch_15 = Watch(reverse)
code_block_22 = CodeBlock { ["Bea","Pepe", "juan", "Alejandro", "María"]; }
code_block_23 = CodeBlock { ["Delgado","Andra","Delgado","Sanz","Sanz"]; }
groupByKey = List.GroupByKey(list=code_block_22, keys=code_block_23)
watch_16 = Watch(groupByKey.groups)
sortByKey = List.SortByKey(list=code_block_22, keys=code_block_23)
watch_17 = Watch(sortByKey.sortedList)
watch_18 = Watch(groupByKey.uniqueKeys)
code_block_24 = CodeBlock()  # same code as code_block_14
code_block_25 = CodeBlock { 123; }
indexOf = List.IndexOf(list=code_block_24, element=code_block_25)
watch_19 = Watch(indexOf)
code_block_26 = CodeBlock()  # same code as code_block_14
code_block_27 = CodeBlock { 3; }
getItemAtIndex = List.GetItemAtIndex(list=code_block_26, index=code_block_27)
watch_20 = Watch(getItemAtIndex)
code_block_28 = CodeBlock()
# ---------- code_block_28.designscript (2 lines) ----------
["1",1,"a","a","b","Dumbledore"
, "yo", "yo","yo","yo","yo"];
# ----------------------------------------
uniqueItems = List.UniqueItems(list=code_block_28)
watch_21 = Watch(uniqueItems)
code_block_29 = CodeBlock { [-3,4,2,3,-5,4]; }
minimumItem = List.MinimumItem(list=code_block_29)
watch_22 = Watch(minimumItem)
maximumItem = List.MaximumItem(list=code_block_29)
watch_23 = Watch(maximumItem)
lastItem = List.LastItem(list=code_block_29)
watch_24 = Watch(lastItem)
firstItem = List.FirstItem(list=code_block_29)
watch_25 = Watch(firstItem)
code_block_30 = CodeBlock()  # same code as code_block_14
code_block_31 = CodeBlock { ["tryout1","tryout2"]; }
code_block_32 = CodeBlock { 6; }
insert = List.Insert(list=code_block_30, element=code_block_31, index=code_block_32)
watch_26 = Watch(insert)
addItemToFront = List.AddItemToFront(item=code_block_30, list=code_block_31)
watch_27 = Watch(addItemToFront)
addItemToEnd = List.AddItemToEnd(item=code_block_30, list=code_block_31)
watch_28 = Watch(addItemToEnd)
code_block_33 = CodeBlock()  # same code as code_block_14
code_block_34 = CodeBlock { 6; }
code_block_35 = CodeBlock { ["tryout1","tryout2"]; }
replaceItemAtIndex = List.ReplaceItemAtIndex(list=code_block_33, index=code_block_34, item=code_block_35)
code_block_36 = CodeBlock { 2; }
dropItems = List.DropItems(list=replaceItemAtIndex, amount=code_block_36)
watch_29 = Watch(dropItems)
code_block_37 = CodeBlock { []; }
code_block_38 = CodeBlock()
# ---------- code_block_38.designscript (2 lines) ----------
["1",1,"a","a","b","Dumbledore"
, "b", 123, 20, "a", 77,"b"];
# ----------------------------------------
code_block_39 = CodeBlock { null; }
code_block_40 = CodeBlock { "a"; }
eq = _ == code_block_40  # unwired: x
replaceByCondition = Replace(item=code_block_38, replaceWith=code_block_39, condition=eq)
create_2 = List.Create(item0=code_block_37, item1=replaceByCondition)
code_block_41 = CodeBlock { false; }
clean = List.Clean(list=create_2, preserveIndices=code_block_41)
watch_30 = Watch(clean)
watch_31 = Watch(replaceItemAtIndex)
code_block_42 = CodeBlock { ["a",["l1","l2",["n1", "n2"]],"b","c"]; }
code_block_43 = CodeBlock { 1; }
flatten = List.Flatten(list=code_block_42, amount=code_block_43)
watch_32 = Watch(flatten)
code_block_44 = CodeBlock { [[1,5],[2,7],[3,null]]; }
transpose = List.Transpose(lists=code_block_44)
watch_33 = Watch(transpose)
flatten_2 = List.Flatten(list=code_block_42)
watch_34 = Watch(flatten_2)
code_block_45 = CodeBlock { [1,4,8,16]; }
code_block_46 = CodeBlock { 4; }
cycle = List.Cycle(list=code_block_45, amount=code_block_46)
watch_35 = Watch(cycle)
code_block_47 = CodeBlock { [1,4,8,16]; }
code_block_48 = CodeBlock { 4; }
ofRepeatedItem = List.OfRepeatedItem(item=code_block_47, amount=code_block_48)
watch_36 = Watch(ofRepeatedItem)
code_block_49 = CodeBlock { [[true,false],false]; }
count_3 = List.Count(list=code_block_49@L2)
watch_37 = Watch(count_3)
code_block_50 = CodeBlock { [[true,true,false],false]; }
countTrue_2 = List.CountTrue(list=code_block_50@L2)
watch_38 = Watch(countTrue_2)
code_block_51 = CodeBlock { -6; }
dropItems_2 = List.DropItems(list=replaceItemAtIndex, amount=code_block_51)
watch_39 = Watch(dropItems_2)
code_block_52 = CodeBlock { true; }
clean_2 = List.Clean(list=create_2, preserveIndices=code_block_52)
watch_40 = Watch(clean_2)
watch_41 = Watch(replaceByCondition)
code_block_53 = CodeBlock { "dict"; }
code_block_54 = CodeBlock { ["Bea","Pepe", "juan", "Alejandro", "María"]; }
code_block_55 = CodeBlock { ["Delgado","Andra","Delgado","Sanz","Sanz"]; }
groupByKey_2 = List.GroupByKey(list=code_block_54, keys=code_block_55)
code_block_56 = CodeBlock { ["a","b","c"]; }
code_block_57 = CodeBlock { ["Peter","James","sirius"]; }

# note: Built In
range = Range(lacing=Longest)
watch_42 = Watch(range)
sequence = Sequence(lacing=Longest)
watch_43 = Watch(sequence)
code_block_58 = CodeBlock { ["1",0,"a","a","b"]; }
code_block_59 = CodeBlock { 0; }
eq_2 = _ == code_block_59  # unwired: x
trueForAll = List.TrueForAll(list=code_block_58@L2, queryFunction=eq_2)
watch_44 = Watch(trueForAll)
code_block_60 = CodeBlock { 0; }
eq_3 = _ == code_block_60  # unwired: x
trueForAny = List.TrueForAny(list=code_block_58, queryFunction=eq_3)
watch_45 = Watch(trueForAny)
code_block_61 = CodeBlock { [true, false, true]; }
allFalse = List.AllFalse(list=code_block_61)
watch_46 = Watch(allFalse)
code_block_62 = CodeBlock { [true, true, true]; }
allTrue = List.AllTrue(list=code_block_62)
watch_47 = Watch(allTrue)
code_block_63 = CodeBlock { ["Peter","James","sirius"]; }
code_block_64 = CodeBlock { ["a","b","c"]; }
code_block_65 = CodeBlock(values=code_block_63, keys=code_block_64) { dict[keys]=values; dict; }
code_block_66 = CodeBlock { "b"; }
containsKey = ContainsKey(list=code_block_65.dict, key=code_block_66)
watch_48 = Watch(containsKey)
code_block_67 = CodeBlock()  # same code as code_block_14
code_block_68 = CodeBlock { 1..3; }
code_block_69 = CodeBlock { 2; }
# note: Core.List
sublists = List.Sublists(list=code_block_67, ranges=code_block_68, offset=code_block_69)
watch_49 = Watch(sublists)
code_block_70 = CodeBlock { [70,28,45,-40, "Alejandro", 0, "Alejandro", "Sófocles", 09, "17"]; }
code_block_71 = CodeBlock { [4,5,2,1,0,9,8,7,3,6]; }
reorder = List.Reorder(list=code_block_70, indices=code_block_71)
watch_50 = Watch(reorder)
shuffle = List.Shuffle(list=code_block_70)
watch_51 = Watch(shuffle)
type_2 = Object.Type()  # unwired: object
sortByFunction = List.SortByFunction(list=code_block_70, sortFunction=type_2)
watch_52 = Watch(sortByFunction)
sortIndexByValue = List.SortIndexByValue(list=code_block_70)
watch_53 = Watch(sortIndexByValue)
string_from_object_2 = FromObject(obj=code_block_70)
length_2 = String.Length(string=string_from_object_2)
sortIndexByValue_2 = List.SortIndexByValue(list=length_2)
watch_54 = Watch(sortIndexByValue_2)
code_block_72 = CodeBlock { [1..100..~2]; }
flatten_3 = List.Flatten(list=code_block_72)
code_block_73 = CodeBlock { [50,25,13,4,1]; }
add = _ + _  # unwired: x, y
map = List.Map(list=code_block_73, f_x=add)
maximumItemByKey = List.MaximumItemByKey(list=flatten_3, keyFunction=map)
watch_55 = Watch(maximumItemByKey)
code_block_74 = CodeBlock { [1..50..~2]; }
flatten_4 = List.Flatten(list=code_block_74)
code_block_75 = CodeBlock { 3; }
takeEveryNthItem = List.TakeEveryNthItem(list=flatten_4, n=code_block_75)
watch_56 = Watch(takeEveryNthItem)
code_block_76 = CodeBlock { 3; }
takeItems = List.TakeItems(list=flatten_4, amount=code_block_76)
watch_57 = Watch(takeItems)
# note: Clockwork
views = Custom[Document.Views]()  # unwired: docOrRevitLinkInstance
code_block_77 = CodeBlock { "FloorPlanView"; }
removeIfNot = List.RemoveIfNot(list=views, type=code_block_77)
watch_58 = Watch(removeIfNot)
code_block_78 = CodeBlock { 3; }
dropEveryNthItem = List.DropEveryNthItem(list=views, n=code_block_78)
watch_59 = Watch(dropEveryNthItem)
code_block_79 = CodeBlock { [1,5,7]; }
removeItemAtIndex = List.RemoveItemAtIndex(list=views, indices=code_block_79)
watch_60 = Watch(removeItemAtIndex)
code_block_80 = CodeBlock { ["Janira","Pedro","Orianna", "Julián","Juan"]; }
code_block_81 = CodeBlock { ["Nerea","Juan"]; }
setDifference = List.SetDifference(list1=code_block_80, list2=code_block_81)
watch_61 = Watch(setDifference)
setIntersection = List.SetIntersection(list1=code_block_80, list2=code_block_81)
watch_62 = Watch(setIntersection)
setUnion = List.SetUnion(list1=code_block_80, list2=code_block_81)
watch_63 = Watch(setUnion)
concat = String.Concat()  # unwired: string0, string1
code_block_82 = CodeBlock { "a"; }
code_block_83 = CodeBlock { ["Janira","Pedro","Orianna", "Julián","Juan"]; }
reduce = List.Reduce(reductor=concat, seed=code_block_82, list1=code_block_83)
# note: ¿Qué hace?
# 1) "Janira" + "a" = "Jairaa"
# 2) "Pedro" + "Janiraa" = "PedroJaniraa"
# 3)"Orianna" + "PedroJaniraa" ...
watch_64 = Watch(reduce)
scan = ScanList(reductor=concat, seed=code_block_82, list1=code_block_83)  # "List.Scan"
watch_65 = Watch(scan)
code_block_84 = CodeBlock { ["na","xx"]; }
cartesianProduct = List.CartesianProduct(comb=concat, list1=code_block_84, list2=code_block_83)
watch_66 = Watch(cartesianProduct)
combinations = List.Combinations()  # unwired: list, length
watch_67 = Watch(combinations)
code_block_85 = CodeBlock { 1..9; }
byCoordinates = Point.ByCoordinates(x=code_block_85, y=code_block_85, lacing=CrossProduct)
isUniformDepth = List.IsUniformDepth(list=byCoordinates)
watch_68 = Watch(isUniformDepth)
code_block_86 = CodeBlock { ["1",0,"a","a","b"]; }
isHomogeneous = List.IsHomogeneous(list=code_block_86)
watch_69 = Watch(isHomogeneous)
isRectangular = List.IsRectangular(list=byCoordinates)
watch_70 = Watch(isRectangular)
add_2 = _ + _  # unwired: x, y
code_block_87 = CodeBlock { [1,2,6,28,23]; }
code_block_88 = CodeBlock { [2,2,2,2,2,2,2,2]; }
laceShortest = List.LaceShortest(comb=add_2, list1=code_block_87, list2=code_block_88)
watch_71 = Watch(laceShortest)
code_block_89 = CodeBlock { [1,4,5,6,7,78,8,99,9]; }
code_block_90 = CodeBlock { 2; }
shiftIndices = List.ShiftIndices(list=code_block_89, amount=code_block_90)
watch_72 = Watch(shiftIndices)
code_block_91 = CodeBlock { 7; }
allIndicesOf = List.AllIndicesOf(list=code_block_89, item=code_block_91)
watch_73 = Watch(allIndicesOf)
code_block_92 = CodeBlock()  # same code as code_block_14
deconstruct = List.Deconstruct(list=code_block_92)
watch_74 = Watch(deconstruct.first)
watch_75 = Watch(deconstruct.rest)
code_block_93 = CodeBlock { ["Jeremy","Ricardo","Lara","Azucena","Lara"]; }
code_block_94 = CodeBlock { "r"; }
contains_2 = String.Contains(searchFor=code_block_94)  # unwired: string
filter = List.Filter(list=code_block_93, condition=contains_2)
watch_76 = Watch(filter.in)
watch_77 = Watch(filter.out)
code_block_95 = CodeBlock { "Lara"; }
firstIndexOf = List.FirstIndexOf(list=code_block_93, item=code_block_95)
watch_78 = Watch(firstIndexOf)
code_block_96 = CodeBlock { [[1,3,5],[2,0,0],[4,8,9]]; }
code_block_97 = CodeBlock(list=code_block_96) { list; }
code_block_98 = CodeBlock { 3; }
diagonalLeft = List.DiagonalLeft(list=code_block_97, rowLength=code_block_98)
watch_79 = Watch(diagonalLeft)
code_block_99 = CodeBlock()
# ---------- code_block_99.designscript (2 lines) ----------
["1",2,"a","a","b","Dumbledore"
, "yo", 123, 20, 3, 77];
# ----------------------------------------
restOfItems = List.RestOfItems(list=code_block_99)
watch_80 = Watch(restOfItems)
code_block_100 = CodeBlock(list=code_block_96) { list; }
code_block_101 = CodeBlock { 3; }
permutations = List.Permutations(list=code_block_100, length=code_block_101)
watch_81 = Watch(permutations)
add_3 = _ + _  # unwired: x, y
code_block_102 = CodeBlock { ["a","b","el"]; }
code_block_103 = CodeBlock(list=code_block_96) { list; }
combine = List.Combine(comb=add_3, list1=code_block_102, list2=code_block_103)
watch_82 = Watch(combine)
diagonalRight = List.DiagonalRight(list=code_block_97, subLength=code_block_98)
watch_83 = Watch(diagonalRight)
code_block_104 = CodeBlock(list2=code_block_102) { list2; }
code_block_105 = CodeBlock(list=code_block_96) { list; }
laceLongest = List.LaceLongest(comb=add_3, list1=code_block_104, list2=code_block_105)
watch_84 = Watch(laceLongest)
code_block_106 = CodeBlock(list=code_block_96) { list; }
rank = List.Rank(list=code_block_106)
watch_85 = Watch(rank)
code_block_107 = CodeBlock { [[1,7],[2,3,4,[4,5,6]],[5,6]]; }
normalizeDepth = List.NormalizeDepth(list=code_block_107)
watch_86 = Watch(normalizeDepth)
code_block_108 = CodeBlock { 2; }
normalizeDepth_2 = List.NormalizeDepth(list=code_block_107, rank=code_block_108)
watch_87 = Watch(normalizeDepth_2)
code_block_109 = CodeBlock { true; }
and_ = And(bool0=code_block_109, bool1=code_block_109)
code_block_110 = CodeBlock { false; }
and_2 = And(bool0=code_block_110, bool1=code_block_110)
create_3 = List.Create(item0=and_, item1=and_2)
allTrue_2 = List.AllTrue(list=create_3)
watch_88 = Watch(allTrue_2)
code_block_111 = CodeBlock { 1..9; }
byCoordinates_2 = Point.ByCoordinates(x=code_block_111, y=code_block_111)
isRectangular_2 = List.IsRectangular(list=byCoordinates_2)
watch_89 = Watch(isRectangular_2)
mod = _ % _  # unwired: x, y
code_block_112 = CodeBlock { [1,2,6,28,23]; }
code_block_113 = CodeBlock { [2,2,2,2,2,2,2,2]; }
laceShortest_2 = List.LaceShortest(comb=mod, list1=code_block_112, list2=code_block_113)
watch_90 = Watch(laceShortest_2)
minimumItemByKey = List.MinimumItemByKey()  # unwired: list, keyFunction
watch_91 = Watch(minimumItemByKey)
add_4 = _ + _  # unwired: x, y
code_block_114 = CodeBlock { 56.3; }
code_block_115 = CodeBlock { [15, [73.7,0],23,12]; }
reduce_2 = List.Reduce(reductor=add_4, seed=code_block_114, list1=code_block_115)
sum = Math.Sum(values=code_block_115)
# note: Si os fijáis da dos resultados: una con el 0 y otro con el 73.7
sum_2 = Math.Sum(values=sum)
add_5 = sum_2 + code_block_114
code_block_116 = CodeBlock { [22,33]; }
cartesianProduct_2 = List.CartesianProduct(comb=add_4, list1=code_block_115, list2=code_block_116)
watch_92 = Watch(cartesianProduct_2)
scan_2 = ScanList(reductor=add_4, seed=code_block_114, list1=code_block_115)  # "List.Scan"
watch_93 = Watch(scan_2)
code_block_117 = CodeBlock { 0; }
removeItemAtIndex_2 = List.RemoveItemAtIndex(list=code_block_106@L2, indices=code_block_117)
rank_2 = List.Rank(list=removeItemAtIndex_2@L2)
watch_94 = Watch(rank_2)
isUniformDepth_2 = List.IsUniformDepth(list=code_block_107)
code_block_118 = CodeBlock { 1; }
normalizeDepth_3 = List.NormalizeDepth(list=code_block_107, rank=code_block_118)
watch_95 = Watch(normalizeDepth_3)

# group: Otros muy utilizados de packages
code_block_119 = CodeBlock { 100; 790; 67; }
number_slider = DoubleSlider(13.3, range=0..100 step 0.1)  # graph input
# note: Lunchbox. Crear
randomNumbers = Lists.Sequence.RandomNumbers(Min=code_block_119.out0, Max=code_block_119.out1, Number=code_block_119.out2, Seed=number_slider)
watch_96 = Watch(randomNumbers)
code_block_120 = CodeBlock { [3,7,1,1,9,2,3,4,5]; }
code_block_121 = CodeBlock { [9,2,3]; }
# note: Rhythm. Eliminar
removeListFromList = Custom[RemoveListFromList](List_A=code_block_120, List_B=code_block_121)
code_block_122 = CodeBlock { [1, 5, 4, 40, 56, 3]; }
code_block_123 = CodeBlock { 3; }
# note: Clockwork. Arreglar
withLeadingZeroes = Custom[List.WithLeadingZeroes](num=code_block_122, n=code_block_123)
type_3 = Object.Type(object=withLeadingZeroes)

code_block_124 = CodeBlock { "dict"; }
code_block_125 = CodeBlock { 145; }
add_6 = _ + code_block_125  # unwired: x
map_2 = List.Map(list=code_block_70, f_x=add_6)
watch_97 = Watch(map_2)
code_block_126 = CodeBlock { [50,-0.5,13,-4,1]; }
mul = _ * _  # unwired: x, y
map_3 = List.Map(list=code_block_126, f_x=mul)
maximumItemByKey_2 = List.MaximumItemByKey(list=flatten_4, keyFunction=map_3)
watch_98 = Watch(maximumItemByKey_2)
code_block_127 = CodeBlock(keys=code_block_56, values=code_block_57) { dict=DesignScript.Dictionary.ByKeysValues(keys,values); }
keys = DesignScript.Builtin.Dictionary.Keys(dictionary=code_block_127)
values = DesignScript.Builtin.Dictionary.Values(dictionary=code_block_127)
