# Dynamo graph Primera_Práctica_Iván.dyn (Dynamo 2.13.1.3887)

categories = Categories("OST_Walls")
all_elements_of_category = ElementsOfCategory(Category=categories)
code_block = CodeBlock { "Comentarios"; }
getParameterValueByName = Element.GetParameterValueByName(element=all_elements_of_category, parameterName=code_block)
code_block_2 = CodeBlock { "EXTERIOR"; }
eq = getParameterValueByName == code_block_2
filterByBoolMask = List.FilterByBoolMask(list=all_elements_of_category, mask=eq)
geometry = Element.Geometry(element=filterByBoolMask.in)
code_block_3 = CodeBlock { "Marca"; }
count = List.Count(list=filterByBoolMask.in)
code_block_4 = CodeBlock(n=count) { 1..n..1; }
string_from_object = FromObject(object=code_block_4)
code_block_5 = CodeBlock(n=string_from_object) { m = "Muro_Exterior_"+n; }
setParameterByName = Element.SetParameterByName(element=filterByBoolMask.in, parameterName=code_block_3, value=code_block_5)
code_block_6 = CodeBlock { "GROSOR"; }
code_block_7 = CodeBlock { "Anchura"; }
getParameterValueByName_2 = Element.GetParameterValueByName(element=all_elements_of_category, parameterName=code_block_7)
setParameterByName_2 = Element.SetParameterByName(element=all_elements_of_category, parameterName=code_block_6, value=getParameterValueByName_2)
