# Dynamo graph Montaje3DMass.dyn (Dynamo 2.13.1.3887)
# packages: spring nodes 210.1.1, Genius Loci 2023.2.21

# group: Seleccionamos las habitaciones/rooms
code_block = CodeBlock { "Habitaciones"; }
byName = Category.ByName(name=code_block)
all_elements_of_category = ElementsOfCategory(Category=byName)

# group: Filtramos aquellas que no tienen una localización establecida
location = Room.Location(room=all_elements_of_category)
isNull = Object.IsNull(object=location)
filterByBoolMask = List.FilterByBoolMask(list=all_elements_of_category, mask=isNull)

# group: Obtenemos la geometría
geometry = Element.Geometry(element=filterByBoolMask.out)
flatten = List.Flatten(list=geometry)

# note: Necesitamos la ruta al archivo de MetricMass.rft
file_path = Filename("..\..\..\ProgramData\Autodesk\RVT 2023\Family Templates\Spanish\Masas conceptuales\Masa métrica.rft")

# group: Generamos los nombres de los archivos
number = Room.Number(room=filterByBoolMask.out)
name = Room.Name(room=filterByBoolMask.out)
# note: Parámetro
code_block_2 = CodeBlock { "Nombre"; }
getParameterValueByName = Element.GetParameterValueByName(element=filterByBoolMask.out, parameterName=code_block_2)
code_block_3 = CodeBlock(a=number, b=name, c=getParameterValueByName) { a+ " - " + b + " - "+ c +" - "; }

code_block_4 = CodeBlock { "Masa"; }
byName_2 = Category.ByName(name=code_block_4)
ꟿ_familyinstance_bygeometry = Custom[ꟿ FamilyInstance.ByGeometry](geometry=flatten, familyTemplatePath=file_path, familyName=code_block_3, category=byName_2)  # package spring nodes; You must provide a valid family template path that will be used for all input geometry objects. The project units(and not the templates) will be used to determine the size of the output geometry. The provided category will be used only if the family template supports it. If not, the default template category will be used instead. Likewise, the family material(provided as a string) will be set only if a material with that name exists in the template. If not, the default material will be used instead ("By Category"). For void cuts, the material settings will be ignored. The Subcategory name is an optional input. If you'd like to skip assigning a Subcategory to any new instance, simply use null. The node expects a unique family name for each geometry object. The rest of the input lists will be processed as if the node lacing is set to longest.

# group: Agrupamos Geometría
groupByKey = List.GroupByKey(list=ꟿ_familyinstance_bygeometry.instance, keys=getParameterValueByName)

flatten_2 = List.Flatten(list=groupByKey.groups)

# group: Seleccionar el esquema de color de la vista seleccionada
# note: Debemos seleccionar la vista en la que están los colores aplicados.
views = Views("WIP - P1")
code_block_5 = CodeBlock { "Habitaciones"; }
byName_3 = Category.ByName(name=code_block_5)
view_get_colorfill_scheme = Custom[View Get ColorFill Scheme](view=views, category=byName_3)  # package Genius Loci; Works only in Revit 2022 and later. Returns the color fill scheme element applied to the view.

# group: Agrupamos por Nombre
groupByKey_2 = List.GroupByKey(list=getParameterValueByName, keys=getParameterValueByName)

# group: Establecer los colores
get_colorfill_scheme_properties = Custom[Get ColorFill Scheme Properties](colorFillScheme=view_get_colorfill_scheme)  # package Genius Loci; Works only in Revit 2022 and later. Gets the category, values, colors and fill patterns of the given Color Scheme.
indexOf = List.IndexOf(list=get_colorfill_scheme_properties.Values, element=groupByKey_2.groups)
getItemAtIndex = List.GetItemAtIndex(list=get_colorfill_scheme_properties.Colors, index=indexOf)

flatten_3 = List.Flatten(list=getItemAtIndex)

# group: Obtener el patrón de relleno
code_block_6 = CodeBlock { "<Relleno Uniforme>"; "Drafting"; }
getByName = FillPatternElement.GetByName(name=code_block_6.out0)

# group: Cargar y sobreescribir los elementos
byProperties = Revit.Filter.OverrideGraphicSettings.ByProperties(cutFillColor=flatten_3, projectionFillColor=flatten_3, cutFillPattern=getByName, projectionFillPattern=getByName)
overrideInView = Element.OverrideInView(element=flatten_2, overrides=byProperties)

count = List.Count(list=flatten_2)
code_block_7 = CodeBlock(i=count) { 0..i-1; }
getItemAtIndex_2 = List.GetItemAtIndex(list=flatten_2, index=code_block_7)
watch = Watch(getItemAtIndex_2)
